# Grasshopper definition importing_from_robo_dk_to_rhino.gh (Grasshopper 1.0.8)

py3 = Python3Script(run=Toggle(False))  # -> target_points, target_planes, target_names, tool_positions, tool_names, object_positions, object_names, path_points, time_total, info
# ---------- py3: Python ----------
import sys
sys.path.append(r'C:\RoboDK\Python')

from robodk import robolink, robomath
import Rhino.Geometry as rg

RDK = robolink.Robolink()

target_points = []
target_planes = []
target_names = []
tool_positions = []
tool_names = []
object_positions = []
object_names = []
info = ""

def pose_to_point(pose):
    return rg.Point3d(pose[0,3], pose[1,3], pose[2,3])

def pose_to_plane(pose):
    origin = rg.Point3d(pose[0,3], pose[1,3], pose[2,3])
    x_axis = rg.Vector3d(pose[0,0], pose[1,0], pose[2,0])
    y_axis = rg.Vector3d(pose[0,1], pose[1,1], pose[2,1])
    return rg.Plane(origin, x_axis, y_axis)

if run:
    log = []

    # ---- TARGETS ----
    try:
        targets = RDK.ItemList(robolink.ITEM_TYPE_TARGET)
        for t in targets:
            pose = t.Pose()
            target_points.append(pose_to_point(pose))
            target_planes.append(pose_to_plane(pose))
            target_names.append(t.Name())
        log.append(f"Targets: {len(target_points)}")
    except Exception as e:
        log.append(f"Targets error: {str(e)}")

    # ---- TOOLS ----
    try:
        tools = RDK.ItemList(robolink.ITEM_TYPE_TOOL)
        for t in tools:
            pose = t.PoseAbs()
            tool_positions.append(pose_to_point(pose))
            tool_names.append(t.Name())
        log.append(f"Tools: {len(tool_positions)}")
    except Exception as e:
        log.append(f"Tools error: {str(e)}")

    # ---- OBJECTS ----
    try:
        objects = RDK.ItemList(robolink.ITEM_TYPE_OBJECT)
        for o in objects:
            pose = o.PoseAbs()
            object_positions.append(pose_to_point(pose))
            object_names.append(o.Name())
        log.append(f"Objects: {len(object_positions)}")
    except Exception as e:
        log.append(f"Objects error: {str(e)}")

    info = " | ".join(log)

else:
    info = "Click run"
# ---------- end py3 ----------
panel = Panel(py3.info)
pt = Point(py3.target_points)
pt_2 = Point(py3.path_points)
pt_3 = Point(py3.tool_positions)
panel_2 = Panel(py3.target_names)
pt_4 = Point(py3.object_positions)
panel_3 = Panel(py3.object_names)
panel_4 = Panel(py3.tool_names)
