# Grasshopper definition cone_to_creal_yarn_model.gh (Grasshopper 1.0.8)

pt = Point(Point(0, 0, 0))
cluster = Cluster(
    A=Slider(60, range=0..1000),
    B=Slider(0.58, range=0..1),
    P=pt,
    G=Toggle(True),
    A_2=Slider(100, range=0..200),
    t=Slider(0.25, range=0..1),
    D=Slider(0, range=0..90),
    R=Slider(0.445, range=0..1))

# ==== cluster Cluster
A = ClusterInput()
A_2 = ClusterInput()
B = ClusterInput()
P = ClusterInput()
division = Division(A=A_2, B=2)
D = ClusterInput()
multiplication = Multiplication(A=A, B=B)
cir = Circle(Plane=P, Radius=division)
rad = Radians(Degrees=D)
subtraction = Subtraction(A=A, B=multiplication)
Z = UnitZ(Factor=1)
t = ClusterInput()
Z_2 = UnitZ(Factor=subtraction)
eval = EvaluateCurve(Curve=reparameterize(cir), Parameter=t)  # -> Point, Tangent, Angle
move = Move(Geometry=P, Motion=Z_2)  # -> Geometry, Transform
vec2pt = Vector2Pt(PointA=move.Geometry, PointB=eval.Point, Unitize=False)  # -> Vector, Length
neg = Negative(Value=eval.Tangent)
line = LineSDL(Start=move.Geometry, Direction=Z, Length=multiplication)
xprod = CrossProduct(VectorA=vec2pt.Vector, VectorB=Z, Unitize=False)  # -> Vector, Length
filter = StreamFilter(Gate=Toggle(True), Stream0=eval.Tangent, Stream1=neg)
vrot = Rotate(Vector=Z, Axis=xprod.Vector, Angle=rad)
R = ClusterInput()
end = EndPoints(Curve=line)  # -> Start, End
biarc = BiArc(StartPoint=eval.Point, StartTangent=filter, EndPoint=move.Geometry, EndTangent=vrot, Ratio=R)  # -> FirstArc, SecondArc, BiArc
ln = Line(StartPoint=eval.Point, EndPoint=end.End)
join = JoinCurves(Curves=[biarc.BiArc, line], Preserve=False)
G = ClusterInput()
filter_2 = StreamFilter(Gate=G, Stream0=ln, Stream1=join)
s_1 = ClusterOutput(filter_2)
