# Grasshopper definition grass_hopper_to_make_point_pairs.gh (Grasshopper 1.0.8)

pt = Point(Point(89, 70, 0))
pt_2 = Point(Point(21, 37, 0))
pt_3 = Point(Point(-10, 191, 0))
pt_4 = Point(Point(0, 163, 166))
cluster = Cluster(start_line_1=pt, B=pt_2, A=pt_3, B_2=pt_4, N=Slider(4, range=2..50))

# ==== cluster Cluster
start_line_1 = ClusterInput()
B = ClusterInput()
A = ClusterInput()
B_2 = ClusterInput()
ln = Line(StartPoint=start_line_1, EndPoint=B)
ln_2 = Line(StartPoint=A, EndPoint=B_2)
N = ClusterInput()
divide = DivideCurve(Curve=ln, Count=expr("x-1", N), Kinks=False)  # -> Points, Tangents, Parameters
divide_2 = DivideCurve(Curve=ln_2, Count=expr("x-1", N), Kinks=False)  # -> Points, Tangents, Parameters
ln_3 = Line(StartPoint=divide.Points, EndPoint=divide_2.Points)
L = ClusterOutput(ln_3)
