# Grasshopper definition grasshopper_to_place_cone.gh (Grasshopper 1.0.8)

number_slider = Slider(44.6, range=0..1000)
brep = Brep(<brep referenced from the Rhino model>)
pt = Point(Point(0, 0, 0))
number_slider_2 = Slider(150, range=0..5000)
number_slider_3 = Slider(406.4, range=0..1000)
number_slider_4 = Slider(1, range=1..50)
number_slider_5 = Slider(339.6, range=0..1000)
number_slider_6 = Slider(2679.7, range=0..5000)
pt_2 = Point(Point(2409.247621, 1159.851361, 1369.105749))
bbox = BoundingBox(Content=brep, Plane=PlaneXY(0, 0, 0))  # -> Box, Box_2
pt_3 = Point(Point(2409.247621, 943.7312349, 2083.044141))
number_slider_7 = Slider(1, range=1..50)
debox = DeconstructBox(Box=bbox.Box)  # -> Plane, X, Y, Z
division = Division(A=number_slider_5, B="2")
pt_4 = Point(Point(3279.61159, 943.7312349, 2.058135835))
dedomain = DeconstructDomain(Domain=debox.X)  # -> Start, End
pt_5 = Point(Point(0, 0, 0))
number_slider_8 = Slider(600, range=0..5000)
number_slider_9 = Slider(400, range=0..1000)
division_2 = Division(A=number_slider_9, B="-2")
division_3 = Division(A=number_slider_8, B="2")
subtraction = Subtraction(A=dedomain.End, B=dedomain.Start)
toggle = BooleanToggle(True)
pt_6 = ConstructPoint(XCoordinate=division_3, YCoordinate=division_2, ZCoordinate="0")
pt_7 = Point(pt_6)
number_slider_10 = Slider(283.525, range=0..500)
brep_2 = Brep(<brep referenced from the Rhino model>)
sph = Sphere(Base=PlaneXY(0, 0, 0), Radius=1)
number_slider_11 = Slider(8, range=0..100)
mesh = Mesh(<mesh referenced from the Rhino model>)
cluster = Cluster(
    relay_2=number_slider_3,
    Y=number_slider_6,
    N=number_slider_5,
    C=number_slider_4,
    relay_3=number_slider_2,
    B_2=division,
    G=brep,
    A=pt,
    relay=number_slider,
    B=pt_3)  # -> L, out_cone_centroid_bottoms, out_cones, out_rectangle
pt_8 = Point(Point(2658.44867, 975.3163464, 1555.577932))
cluster_2 = Cluster(
    relay_2=number_slider_3,
    Y=number_slider_6,
    N=number_slider_5,
    C=number_slider_4,
    relay_3=number_slider_2,
    B_2=division,
    G=brep,
    A=pt,
    relay=number_slider,
    B=pt_2)  # -> L, out_cone_centroid_bottoms, out_cones, out_rectangle
merge = Merge(
    Data1=number_slider_3,
    Data2=number_slider_4,
    Data3=number_slider_6,
    Data4=number_slider_6,
    Data5=number_slider_2,
    Data6=number_slider,
    Data7=number_slider_7)
cluster_3 = Cluster(
    relay_2=number_slider_3,
    Y=number_slider_6,
    N=number_slider_5,
    C=number_slider_7,
    relay_3=number_slider_2,
    B_2=division,
    G=brep,
    A=pt,
    relay=number_slider,
    B=pt_4)  # -> L, out_cone_centroid_bottoms, out_cones, out_rectangle
yarn_radius = Slider(2, range=0..5)
pt_9 = Point(Point(2880.910316, 975.3163464, 1555.577932))
pt_10 = Point(Point(2934.405819, 1218.210956, 2033.903443))
pt_11 = Point(Point(2934.405819, 2258.685291, 2033.903443))
pt_12 = Point(Point(2934.405819, 1218.210956, 2033.903443))
pt_13 = Point(Point(3091.937875, 1223.763175, 2033.903443))
cluster_4 = Cluster_3(C=brep)
filter = StreamFilter(Gate=toggle, Stream0=number_slider_10, Stream1="0")
cluster_5 = Cluster_3(C=mesh)
division_4 = Division(A=subtraction, B="2")
scale_nu = ScaleNU(
    Geometry=sph,
    Plane=PlaneXY(0, 0, 0),
    ScaleX=Slider(142.968, range=0..500),
    ScaleY=Slider(74.975, range=0..500),
    ScaleZ=number_slider_10)  # -> Geometry, Transform
subtraction_2 = Subtraction(A=cluster_4, B="7")
addition = Addition(A=filter, B=cluster_5)
pt_14 = Point(Point(2934.405819, 3753.066381, 2033.903443))
brep_3 = Brep(<brep referenced from the Rhino model>)
pt_15 = Point(Point(3076.70422, 3737.626507, 2033.903443))
pt_16 = Point(Point(2658.44867, 3929.71677, 1555.577932))
pt_17 = Point(Point(2880.910316, 3951.765053, 1555.577932))
pt_18 = Point(Point(2934.405819, 3753.066381, 2033.903443))
addition_2 = Addition(A="42", B="1")
pt_19 = Point(Point(2934.405819, 2708.838534, 2033.903443))
filter_2 = StreamFilter(Gate=toggle, Stream0=scale_nu.Geometry, Stream1=brep_2)
vec = VectorXYZ(XComponent="0", YComponent="0", ZComponent=subtraction_2)  # -> Vector, Length
vec_2 = VectorXYZ(XComponent="0", YComponent="0", ZComponent=addition)  # -> Vector, Length
cluster_6 = Cluster(
    relay_2=number_slider_9,
    Y=number_slider_8,
    N=subtraction,
    C=Slider(3, range=1..50),
    relay_3=division_4,
    B_2="0",
    G=brep,
    A=pt_5,
    relay=division_4,
    B=pt_7)  # -> L, out_cone_centroid_bottoms, out_cones, out_rectangle
addition_3 = Addition(A=addition_2, B="1")
py3 = Python3Script(name="celling", trigger=Button(), geometry=brep_3, color=ColourSwatch(SwatchColor=RGB(215, 211, 35)))  # -> out, a
# ---------- py3: Python ----------
import Rhino.Geometry as rg
import scriptcontext as sc
import System
import struct
import os
import sys

# ---------------------------------------------------------------------------
# Inputs:
#   geometry   : any geometry (mesh, brep, guid) — flat list or tree
#   name       : string — name for the object in RoboDK
#   color      : colour — optional, defaults to grey
#   trigger    : boolean — set True to push
# ---------------------------------------------------------------------------

if trigger:
    sc.sticky[f"last_{name}_done"] = False
    print(f"Trigger activated for '{name}'")

if not trigger and sc.sticky.get(f"last_{name}_done", False):
    print("No trigger — skipping")
else:
    # -----------------------------------------------------------------------
    # Flatten any input type into a list of geometry items
    # -----------------------------------------------------------------------
    def flatten(gh_input):
        result = []
        if hasattr(gh_input, 'Branches'):
            for branch in gh_input.Branches:
                for item in branch:
                    if item is not None:
                        result.append(item)
        elif hasattr(gh_input, '__iter__') and not isinstance(gh_input, (rg.Mesh, rg.Point3d)):
            for item in gh_input:
                if item is not None:
                    result.append(item)
        elif gh_input is not None:
            result.append(gh_input)
        return result

    geo_list = flatten(geometry)
    print(f"'{name}': {len(geo_list)} items")

    # -----------------------------------------------------------------------
    # Build combined mesh
    # -----------------------------------------------------------------------
    mesh_list = rg.Mesh()
    for geo in geo_list:
        if isinstance(geo, rg.Mesh):
            geo.Faces.ConvertQuadsToTriangles()
            mesh_list.Append(geo)
        elif isinstance(geo, rg.Brep):
            meshes = rg.Mesh.CreateFromBrep(geo, rg.MeshingParameters.Coarse)
            if meshes:
                for m in meshes:
                    m.Faces.ConvertQuadsToTriangles()
                    mesh_list.Append(m)
        elif isinstance(geo, System.Guid):
            obj = sc.doc.Objects.FindId(geo)
            if obj:
                g = obj.Geometry
                if isinstance(g, rg.Mesh):
                    g.Faces.ConvertQuadsToTriangles()
                    mesh_list.Append(g)
                elif isinstance(g, rg.Brep):
                    meshes = rg.Mesh.CreateFromBrep(g, rg.MeshingParameters.Coarse)
                    if meshes:
                        for m in meshes:
                            m.Faces.ConvertQuadsToTriangles()
                            mesh_list.Append(m)

    mesh_list.Faces.ConvertQuadsToTriangles()
    triangles = []
    for i in range(mesh_list.Faces.Count):
        face = mesh_list.Faces[i]
        triangles.append((
            mesh_list.Vertices[face.A],
            mesh_list.Vertices[face.B],
            mesh_list.Vertices[face.C]
        ))
    print(f"  {len(triangles)} triangles")

    # -----------------------------------------------------------------------
    # Write STL
    # -----------------------------------------------------------------------
    safe_name = name.replace(" ", "_")
    stl_path = f"C:/temp/{safe_name}.stl"
    os.makedirs("C:/temp", exist_ok=True)
    with open(stl_path, 'wb') as f:
        f.write(b'\0' * 80)
        f.write(struct.pack('<I', len(triangles)))
        for v0, v1, v2 in triangles:
            f.write(struct.pack('<fff', 0, 0, 0))
            f.write(struct.pack('<fff', v0.X, v0.Y, v0.Z))
            f.write(struct.pack('<fff', v1.X, v1.Y, v1.Z))
            f.write(struct.pack('<fff', v2.X, v2.Y, v2.Z))
            f.write(struct.pack('<H', 0))
    print(f"  STL -> {stl_path}")

    # -----------------------------------------------------------------------
    # Resolve colour input to [R, G, B, A] 0-1
    # -----------------------------------------------------------------------
    def resolve_color(c, default):
        if c is None:
            return default
        raw = c
        if hasattr(c, 'Branches'):
            try: raw = list(c.Branches[0])[0]
            except: return default
        if type(raw).__name__ == 'Color' or (hasattr(raw, 'R') and hasattr(raw, 'G') and hasattr(raw, 'B')):
            return [raw.R/255.0, raw.G/255.0, raw.B/255.0, raw.A/255.0 if hasattr(raw,'A') else 1.0]
        return default

    rgba = resolve_color(color, [0.6, 0.6, 0.65, 1.0])

    # -----------------------------------------------------------------------
    # Push to RoboDK
    # -----------------------------------------------------------------------
    try:
        sys.path.append("C:/RoboDK/Python")
        from robodk.robolink import Robolink

        RDK = Robolink()
        station = RDK.Item("", 1)
        print(f"  Station: {station.Name()}")

        # Purge any existing item with this name
        for _ in range(50):
            old = RDK.Item(safe_name)
            if not old.Valid(): break
            old.Delete()
            print(f"  purged old '{safe_name}'")

        # Load via snapshot
        before = set(it.item for it in RDK.ItemList(6, False))
        RDK.AddFile(stl_path)
        new_item = None
        for it in RDK.ItemList(6, False):
            if it.item not in before:
                new_item = it
                break
        if new_item is None:
            new_item = RDK.Item(safe_name)

        if new_item.Valid():
            new_item.setColor(rgba)
            print(f"  '{new_item.Name()}' loaded, color={[round(v,2) for v in rgba]}")
        else:
            print(f"  WARNING: item not valid after load")

        sc.sticky[f"last_{name}_done"] = True

    except Exception as e:
        print(f"RoboDK error: {e}")
        import traceback
        traceback.print_exc()
# ---------- end py3 ----------
move = Move(Geometry=filter_2, Motion=vec_2.Vector)  # -> Geometry, Transform
move_2 = Move(Geometry=cluster_2.out_cone_centroid_bottoms, Motion=vec.Vector)  # -> Geometry, Transform
random = Random(Range=Domain(0, 1), Number=cluster_2.L, Seed=addition_3)
cluster_7 = Cluster_4(start_line_1=pt_8, B=pt_9, A=pt_10, B_2=pt_11, N=number_slider_11)
random_2 = Random(Range=Domain(0, 1), Number=cluster_2.L, Seed=addition_2)
cluster_8 = Cluster_4(start_line_1=pt_12, B=pt_13, A=pt_10, B_2=pt_11, N=number_slider_11)
py3_2 = Python3Script(seed="42", count=cluster_2.L)  # -> flatten(a)
# ---------- py3_2: Python ----------
import random

# Inputs: count (integer), seed (integer)

random.seed(seed)
a = [random.choice([True, False]) for _ in range(count)]
# ---------- end py3_2 ----------
cluster_9 = Cluster_4(start_line_1=pt_16, B=pt_17, A=pt_18, B_2=pt_19, N=number_slider_11)
cluster_10 = Cluster_4(start_line_1=pt_8, B=pt_9, A=pt_12, B_2=pt_13, N=number_slider_11)
panel = Panel(cluster_2.L)
panel_2 = Panel(cluster.L)
panel_3 = Panel(cluster_3.L)
pt_20 = Point(Point(199.9900957, 0, 718.6517922))
cluster_11 = Cluster_4(start_line_1=pt_14, B=pt_15, A=pt_18, B_2=pt_19, N=number_slider_11)
cluster_12 = Cluster_4(start_line_1=pt_16, B=pt_17, A=pt_14, B_2=pt_15, N=number_slider_11)
merge_2 = Merge(Data1=move.Geometry, Data2=mesh)
pt_21 = Point(Point(0, 119, 834.0691612))
panel_4 = Panel(cluster_3.out_cones)
pt_22 = Point(Point(0, 0, 0))
rotate = Rotate(Geometry=cluster_6.out_cone_centroid_bottoms, Angle="pi/2", Plane=pt_7)  # -> Geometry, Transform
rotate_2 = Rotate(Geometry=cluster_6.out_cones, Angle="pi/2", Plane=pt_7)  # -> Geometry, Transform
rotate_3 = Rotate(Geometry=cluster_6.out_rectangle, Angle="pi/2", Plane=pt_7)  # -> Geometry, Transform
merge_3 = Merge(Data1=cluster_10, Data2=cluster_8)
addition_4 = Addition(A=cluster_2.L, B=cluster.L, C=cluster_3.L)
merge_4 = Merge(Data1=cluster_12, Data2=cluster_11)
merge_5 = Merge(Data1=cluster_7, Data2=cluster_9)  # -> flatten(Result)
py3_3 = Python3Script(geometry=flatten(merge_2), trigger=Toggle(True), pickup_point=pt_20, knotting_point=pt_21, flange_origin=pt_22)  # -> out, a; inputs geometry: tree
# ---------- py3_3: Python ----------
from Grasshopper import DataTree
import Rhino
import Rhino.Geometry as rg
import scriptcontext as sc
import System
import struct
import os
import sys

# Clear cached path so the gate below lets the rebuild through
if trigger:
    sc.sticky["last_ee_stl_path"] = ""
    print("Trigger activated, forcing re-run")

# ---------------------------------------------------------------------------
# Helper: flatten a GH input into a flat list
# ---------------------------------------------------------------------------
def flatten_input(gh_input, exclude_type=None):
    result = []
    if hasattr(gh_input, 'Branches'):
        for branch in gh_input.Branches:
            for item in branch:
                if item is not None:
                    result.append(item)
    elif hasattr(gh_input, '__iter__') and (exclude_type is None or not isinstance(gh_input, exclude_type)):
        for item in gh_input:
            if item is not None:
                result.append(item)
    elif gh_input is not None:
        result.append(gh_input)
    return result

# ---------------------------------------------------------------------------
# Resolve a single point to rg.Point3d
# ---------------------------------------------------------------------------
def resolve_point(pt):
    if pt is None:
        return None
    if isinstance(pt, System.Guid):
        rhino_obj = sc.doc.Objects.FindId(pt)
        if rhino_obj:
            geo = rhino_obj.Geometry
            if isinstance(geo, rg.Point):
                return geo.Location
            elif hasattr(geo, 'Location'):
                return geo.Location
            else:
                return geo.GetBoundingBox(True).Center
        print(f"  Could not find Guid: {pt}")
        return None
    elif isinstance(pt, rg.Point3d):
        return pt
    elif isinstance(pt, rg.Point):
        return pt.Location
    elif hasattr(pt, 'X') and hasattr(pt, 'Y') and hasattr(pt, 'Z'):
        return rg.Point3d(pt.X, pt.Y, pt.Z)
    print(f"  Unknown point type: {type(pt)}")
    return None

def resolve_first_point(gh_input):
    items = flatten_input(gh_input, exclude_type=rg.Point3d)
    if not items:
        return resolve_point(gh_input)
    for item in items:
        pt = resolve_point(item)
        if pt is not None:
            return pt
    return None

# ---------------------------------------------------------------------------
# Collect inputs
#
# geometry        : EE meshes/breps
# flange_origin   : point in Rhino model space that corresponds to the robot
#                   flange (tool0). Everything else is offset from here.
#                   Typically this is the centre of the mounting face of the EE.
# pickup_point    : point on the EE in Rhino model space
# knotting_point  : point on the EE in Rhino model space
# ---------------------------------------------------------------------------
geo_list          = flatten_input(geometry)
resolved_flange   = resolve_first_point(flange_origin)
resolved_pickup   = resolve_first_point(pickup_point)
resolved_knot     = resolve_first_point(knotting_point)

print(f"Found {len(geo_list)} geometry items")
print(f"flange_origin  : {resolved_flange}")
print(f"pickup_point   : {resolved_pickup}")
print(f"knotting_point : {resolved_knot}")

if resolved_flange is None:
    print("WARNING: flange_origin not connected — tool offsets will be wrong!")
    print("  Connect a point at the robot mounting face of the EE geometry.")

# ---------------------------------------------------------------------------
# Gate: only rebuild on trigger
# ---------------------------------------------------------------------------
if not trigger and sc.sticky.get("last_ee_stl_path", "") != "":
    a = sc.sticky.get("last_ee_stl_path", "")
    print("Trigger not set — skipping. Fire trigger to rebuild.")
else:
    print("Rebuilding...")

    # -----------------------------------------------------------------------
    # Build combined mesh and write STL
    # -----------------------------------------------------------------------
    stl_path  = "C:/temp/end_effector.stl"
    mesh_list = rg.Mesh()

    for i, geo in enumerate(geo_list):
        if isinstance(geo, rg.Mesh):
            geo.Faces.ConvertQuadsToTriangles()
            mesh_list.Append(geo)
        elif isinstance(geo, rg.Brep):
            meshes = rg.Mesh.CreateFromBrep(geo, rg.MeshingParameters.Coarse)
            if meshes:
                for m in meshes:
                    m.Faces.ConvertQuadsToTriangles()
                    mesh_list.Append(m)
        elif isinstance(geo, System.Guid):
            rhino_obj = sc.doc.Objects.FindId(geo)
            if rhino_obj:
                obj_geo = rhino_obj.Geometry
                if isinstance(obj_geo, rg.Mesh):
                    obj_geo.Faces.ConvertQuadsToTriangles()
                    mesh_list.Append(obj_geo)
                elif isinstance(obj_geo, rg.Brep):
                    meshes = rg.Mesh.CreateFromBrep(obj_geo, rg.MeshingParameters.Coarse)
                    if meshes:
                        for m in meshes:
                            m.Faces.ConvertQuadsToTriangles()
                            mesh_list.Append(m)

    mesh_list.Faces.ConvertQuadsToTriangles()
    triangles = []
    for i in range(mesh_list.Faces.Count):
        face = mesh_list.Faces[i]
        triangles.append((
            mesh_list.Vertices[face.A],
            mesh_list.Vertices[face.B],
            mesh_list.Vertices[face.C]
        ))
    print(f"Triangles: {len(triangles)}")

    os.makedirs(os.path.dirname(stl_path), exist_ok=True)
    with open(stl_path, 'wb') as f:
        f.write(b'\0' * 80)
        f.write(struct.pack('<I', len(triangles)))
        for v0, v1, v2 in triangles:
            f.write(struct.pack('<fff', 0, 0, 0))
            f.write(struct.pack('<fff', v0.X, v0.Y, v0.Z))
            f.write(struct.pack('<fff', v1.X, v1.Y, v1.Z))
            f.write(struct.pack('<fff', v2.X, v2.Y, v2.Z))
            f.write(struct.pack('<H', 0))
    print(f"STL written to {stl_path}")

    # -----------------------------------------------------------------------
    # RoboDK
    #
    # Tool offset strategy:
    #   Your GH model has the EE near the Rhino origin. The robot flange in
    #   RoboDK is somewhere in world space. The tool offset (what AddTool needs)
    #   is simply the vector from the flange mounting point to the tool point,
    #   expressed in the flange coordinate frame.
    #
    #   We compute this purely in Rhino model space:
    #     offset = tool_point - flange_origin
    #
    #   This delta is the same regardless of where the robot sits in RoboDK
    #   world space, because AddTool always wants the offset relative to
    #   the flange — not relative to the world.
    # -----------------------------------------------------------------------
    try:
        sys.path.append("C:/RoboDK/Python")
        from robodk.robolink import Robolink
        from robodk.robomath import Mat

        def identity():
            return Mat([[1,0,0,0],[0,1,0,0],[0,0,1,0],[0,0,0,1]])

        def offset_pose(dx, dy, dz):
            """Pure translation pose — offset from flange origin in flange space."""
            return Mat([[1,0,0,dx],[0,1,0,dy],[0,0,1,dz],[0,0,0,1]])

        RDK = Robolink()
        station = RDK.Item("", 1)
        print(f"Station: {station.Name()}")

        def purge_all(name):
            count = 0
            for _ in range(50):
                item = RDK.Item(name)
                if not item.Valid():
                    break
                item.Delete()
                count += 1
            if count:
                print(f"  purged {count}x '{name}'")

        def add_file_and_get_item(path):
            before = set(it.item for it in RDK.ItemList(6, False))
            RDK.AddFile(path)
            for it in RDK.ItemList(6, False):
                if it.item not in before:
                    print(f"  -> loaded '{it.Name()}' id={it.item}")
                    return it
            stem = os.path.splitext(os.path.basename(path))[0]
            fb = RDK.Item(stem)
            print(f"  -> fallback name '{stem}' valid={fb.Valid()}")
            return fb

        # Purge old items
        purge_all("end_effector")
        purge_all("pickup_point")
        purge_all("knotting_point")
        purge_all("EndEffector")

        # Find robot by name
        robot = RDK.Item("Fanuc R2000iC 125L")
        if not robot.Valid():
            robot = RDK.Item("", 4)
        if not robot.Valid():
            robot = RDK.Item("", 2)
        print(f"Robot: valid={robot.Valid()} name='{robot.Name() if robot.Valid() else 'N/A'}'")

        ee_parent = robot if robot.Valid() else station

        # EE frame — organisational only, identity pose
        ee_frame = RDK.AddFrame("EndEffector", ee_parent)
        ee_frame.setPose(identity())

        # STL — no pose override
        ee_obj = add_file_and_get_item(stl_path)
        if ee_obj.Valid():
            ee_obj.setColor([0.6, 0.6, 0.65, 1.0])
            ee_obj.setParent(ee_frame)
            print("end_effector: ok")
        else:
            print("WARNING: end_effector STL not valid")

        # Compute tool offsets as deltas in Rhino model space.
        # flange_origin is where the robot mounting face is in the GH model.
        # The delta from there to each tool point is the TCP offset for AddTool.
        fo = resolved_flange if resolved_flange is not None else rg.Point3d(0, 0, 0)
        print(f"Using flange_origin: ({fo.X:.1f}, {fo.Y:.1f}, {fo.Z:.1f})")

        if resolved_pickup is not None and robot.Valid():
            dx = resolved_pickup.X - fo.X
            dy = resolved_pickup.Y - fo.Y
            dz = resolved_pickup.Z - fo.Z
            robot.AddTool(offset_pose(dx, dy, dz), "pickup_point")
            print(f"pickup_point tool offset: ({dx:.1f}, {dy:.1f}, {dz:.1f})")
        elif resolved_pickup is not None:
            print("WARNING: no robot — pickup_point skipped")
        else:
            print("WARNING: pickup_point input is None")

        if resolved_knot is not None and robot.Valid():
            dx = resolved_knot.X - fo.X
            dy = resolved_knot.Y - fo.Y
            dz = resolved_knot.Z - fo.Z
            robot.AddTool(offset_pose(dx, dy, dz), "knotting_point")
            print(f"knotting_point tool offset: ({dx:.1f}, {dy:.1f}, {dz:.1f})")
        elif resolved_knot is not None:
            print("WARNING: no robot — knotting_point skipped")
        else:
            print("WARNING: knotting_point input is None")

        print("Done")

    except Exception as e:
        print(f"RoboDK error: {e}")
        import traceback
        traceback.print_exc()

    sc.sticky["last_ee_stl_path"] = stl_path
    a = stl_path
# ---------- end py3_3 ----------
merge_6 = Merge(Data1=merge_3, Data2=merge_4)
panel_5 = Panel(addition_4)
filter_3 = StreamFilter(Gate=Toggle(True), Stream0=merge_5, Stream1=merge_6)  # -> flatten(Stream)
cluster_13 = Cluster_2(
    A=Slider(480, range=0..1000),
    B=random,
    P=move_2.Geometry,
    A_2=Slider(173.8, range=0..200),
    t=random_2,
    D=Slider(0, range=0..90),
    panel_3=py3_2,
    R=Slider(0.412, range=0..1))  # -> flatten(R_2)
merge_7 = Merge(Data1=cluster_13, Data2=filter_3)
pipe = Pipe(Curve=merge_7, Radius=yarn_radius, Caps="1", FitRail=False)  # -> flatten(Pipe)
toggle_2 = BooleanToggle(True)
filter_4 = StreamFilter(Gate=toggle_2, Stream1=cluster_3.out_cones)
toggle_3 = BooleanToggle(True)
filter_5 = StreamFilter(Gate=toggle_2, Stream1=cluster.out_cone_centroid_bottoms)
filter_6 = StreamFilter(Gate=toggle_3, Stream1=cluster.out_cones)
filter_7 = StreamFilter(Gate=toggle_3, Stream1=cluster_3.out_cone_centroid_bottoms)
merge_8 = Merge(Data1=cluster_2.out_cones, Data2=filter_6, Data3=filter_4)  # -> flatten(Result)
addition_5 = Addition(A=cluster_4, B=Slider(402.308, range=0..1000))
mesh_2 = MeshBrep(
    Brep=pipe,
    Settings={GridMaxCount=0, GridMinCount=16, JaggedSeams=False, MaxEdgeLength=5000, MinEdgeLength=50, MinTolerance=0, Refine=True, RefineAngle=0, RelativeTolerance=0.65, SimplePlanes=True, Tolerance=0})  # -> flatten(Mesh)
flatten = FlattenTree(Tree=merge_8, Path="{0}")
merge_9 = Merge(Data1=cluster_2.out_cone_centroid_bottoms, Data2=filter_7, Data3=filter_5)
vec_3 = VectorXYZ(XComponent="0", YComponent="0", ZComponent=cluster_4)  # -> Vector, Length
vec_4 = VectorXYZ(XComponent="0", YComponent="0", ZComponent=addition_5)  # -> Vector, Length
mesh_3 = MeshBrep(
    Brep=flatten,
    Settings={GridMaxCount=0, GridMinCount=16, JaggedSeams=False, MaxEdgeLength=5000, MinEdgeLength=50, MinTolerance=0, Refine=True, RefineAngle=0, RelativeTolerance=0.65, SimplePlanes=True, Tolerance=0})  # -> flatten(Mesh)
move_3 = Move(Geometry=merge_9, Motion=vec_3.Vector)  # -> flatten(Geometry), Transform
move_4 = Move(Geometry=merge_9, Motion=vec_4.Vector)  # -> flatten(Geometry), Transform
panel_6 = Panel(mesh_3)
panel_7 = Panel(move_3.Geometry)
swatch = ColourSwatch(SwatchColor=RGB(204, 35, 35))
py3_4 = Python3Script(
    cones=flatten(mesh_3),
    grab_points=flatten(move_3.Geometry),
    trigger=flatten(Button()),
    strings=flatten(mesh_2),
    string_grab_points=flatten(move_4.Geometry),
    cone_color=swatch,
    string_color=swatch)  # -> out, a; inputs cones: list, grab_points: list, trigger: list, strings: list, string_grab_points: list
# ---------- py3_4: Python ----------
from Grasshopper import DataTree
import Rhino
import Rhino.Geometry as rg
import scriptcontext as sc
import System
import struct
import os
import sys

# Force re-run if trigger is True
if trigger:
    sc.sticky["last_geo_count"] = -1
    sc.sticky["last_pt_count"] = -1
    sc.sticky["last_strings_count"] = -1
    sc.sticky["last_string_pts_count"] = -1
    print("Trigger activated, forcing re-run")

# ---------------------------------------------------------------------------
# Helper: flatten any GH input into a flat list
# ---------------------------------------------------------------------------
def flatten_input(gh_input, exclude_type=None):
    result = []
    if hasattr(gh_input, 'Branches'):
        for branch in gh_input.Branches:
            for item in branch:
                if item is not None:
                    result.append(item)
    elif hasattr(gh_input, '__iter__') and (exclude_type is None or not isinstance(gh_input, exclude_type)):
        for item in gh_input:
            if item is not None:
                result.append(item)
    elif gh_input is not None:
        result.append(gh_input)
    return result

# ---------------------------------------------------------------------------
# Resolve a single value to rg.Point3d
# ---------------------------------------------------------------------------
def resolve_point(pt):
    if isinstance(pt, System.Guid):
        rhino_obj = sc.doc.Objects.FindId(pt)
        if rhino_obj:
            geo = rhino_obj.Geometry
            if isinstance(geo, rg.Point):
                return geo.Location
            elif hasattr(geo, 'Location'):
                return geo.Location
            else:
                return geo.GetBoundingBox(True).Center
        print(f"  Could not find Guid: {pt}")
        return None
    elif isinstance(pt, rg.Point3d):
        return pt
    elif isinstance(pt, rg.Point):
        return pt.Location
    elif hasattr(pt, 'X') and hasattr(pt, 'Y') and hasattr(pt, 'Z'):
        return rg.Point3d(pt.X, pt.Y, pt.Z)
    print(f"  Unknown point type: {type(pt)}")
    return None

# ---------------------------------------------------------------------------
# Diagnose the raw GH tree structure so we can see exactly what's coming in
# ---------------------------------------------------------------------------
def diagnose_tree(name, gh_input):
    if hasattr(gh_input, 'Branches'):
        paths = list(gh_input.Paths)
        print(f"  {name}: DataTree with {len(gh_input.Branches)} branches")
        for j, (path, branch) in enumerate(zip(paths, gh_input.Branches)):
            print(f"    branch[{j}] path={path}  items={len(branch)}  types={list(set(type(x).__name__ for x in branch))}")
    elif hasattr(gh_input, '__iter__') and not isinstance(gh_input, (rg.Mesh, rg.Point3d)):
        items = list(gh_input)
        print(f"  {name}: iterable, len={len(items)}, types={list(set(type(x).__name__ for x in items))}")
    else:
        print(f"  {name}: single item, type={type(gh_input).__name__}")

print("=== INPUT DIAGNOSTICS ===")
diagnose_tree("cones", cones)
diagnose_tree("grab_points", grab_points)
diagnose_tree("string_grab_points", string_grab_points)
diagnose_tree("strings", strings)
print("=========================")

# ---------------------------------------------------------------------------
# Resolve optional color inputs to RoboDK [R, G, B, A] (0.0-1.0 floats)
#
# Accepts any of:
#   - System.Drawing.Color  (from GH Colour param)
#   - Rhino.Display.ColorHSL or similar with .R .G .B properties
#   - A list/tuple of 3 or 4 numbers (0-1 or 0-255 detected automatically)
#   - None / missing → uses the supplied default
# ---------------------------------------------------------------------------
def resolve_color(gh_color, default_rgba):
    """Return [R, G, B, A] floats 0-1 from a GH colour input, or default."""
    if gh_color is None:
        return default_rgba

    def color_from_raw(raw):
        """Convert a single colour object to [R,G,B,A] 0-1, or None if unrecognised."""
        if raw is None:
            return None
        # System.Drawing.Color — R/G/B/A are 0-255 ints
        type_name = type(raw).__name__
        if type_name == 'Color' or (hasattr(raw, 'R') and hasattr(raw, 'G') and hasattr(raw, 'B') and hasattr(raw, 'A')):
            return [raw.R / 255.0, raw.G / 255.0, raw.B / 255.0, raw.A / 255.0]
        # Plain numeric tuple/list [r,g,b] or [r,g,b,a]
        if isinstance(raw, (list, tuple)) and all(isinstance(v, (int, float)) for v in raw):
            vals = list(raw)[:4]
            if any(v > 1.0 for v in vals):
                vals = [v / 255.0 for v in vals]
            while len(vals) < 4:
                vals.append(1.0)
            return vals
        return None

    # DataTree — grab first item from first branch
    if hasattr(gh_color, 'Branches'):
        try:
            raw = list(gh_color.Branches[0])[0]
            result = color_from_raw(raw)
            return result if result else default_rgba
        except Exception:
            return default_rgba

    # Try direct conversion first (catches System.Drawing.Color before iterating)
    result = color_from_raw(gh_color)
    if result:
        return result

    # GH wrapper that is iterable — extract first real item safely
    if hasattr(gh_color, '__iter__') and not isinstance(gh_color, str):
        try:
            for item in gh_color:
                if item is not None:
                    result = color_from_raw(item)
                    if result:
                        return result
                    break  # only try first item
        except Exception:
            pass

    return default_rgba

cone_rgba   = resolve_color(cone_color,   [1.0, 0.0, 0.0, 1.0])  # default red
string_rgba = resolve_color(string_color, [0.0, 1.0, 0.0, 1.0])  # default green
print(f"cone_color:   {[round(v,3) for v in cone_rgba]}")
print(f"string_color: {[round(v,3) for v in string_rgba]}")

# ---------------------------------------------------------------------------
# Collect inputs
#
# cones: we support two modes automatically:
#   MODE A — DataTree with one branch per cone (graft in GH)
#             Each branch can have multiple meshes for that cone.
#   MODE B — flat list / single-branch tree where each item = one cone mesh
#             We treat each item as its own cone (one mesh per cone).
#
# grab_points / string_grab_points: always flat, one point per cone.
# ---------------------------------------------------------------------------

# Build cone_branches: list-of-lists, one sub-list per cone
cone_branches = []
if hasattr(cones, 'Branches') and len(cones.Branches) > 1:
    # MODE A: proper per-cone branches
    for branch in cones.Branches:
        items = [item for item in branch if item is not None]
        if items:
            cone_branches.append(items)
    print(f"MODE A: {len(cone_branches)} branches from DataTree")
else:
    # MODE B: flat — each item is its own cone
    flat = flatten_input(cones, exclude_type=rg.Mesh)
    for item in flat:
        cone_branches.append([item])
    print(f"MODE B: {len(cone_branches)} cones from flat list (one mesh each)")

strings_list    = flatten_input(strings, exclude_type=rg.Mesh)
cone_grab_pts   = [resolve_point(p) for p in flatten_input(grab_points)]
string_grab_pts = [resolve_point(p) for p in flatten_input(string_grab_points)]

num_cones = len(cone_branches)
print(f"num_cones={num_cones}  cone_grab_pts={len(cone_grab_pts)}  string_grab_pts={len(string_grab_pts)}  strings={len(strings_list)}")
for i, p in enumerate(cone_grab_pts):
    if p: print(f"  cone_grab_{i}: ({p.X:.1f}, {p.Y:.1f}, {p.Z:.1f})")
for i, p in enumerate(string_grab_pts):
    if p: print(f"  string_grab_{i}: ({p.X:.1f}, {p.Y:.1f}, {p.Z:.1f})")

# ---------------------------------------------------------------------------
# Change detection — hash on counts (trigger forces re-run via sticky reset)
# ---------------------------------------------------------------------------
geo_count    = sum(len(b) for b in cone_branches)
pt_count     = len(cone_grab_pts)
str_count    = len(strings_list)
str_pt_count = len(string_grab_pts)

if (geo_count    == sc.sticky.get("last_geo_count",        -1) and
    pt_count     == sc.sticky.get("last_pt_count",         -1) and
    str_count    == sc.sticky.get("last_strings_count",    -1) and
    str_pt_count == sc.sticky.get("last_string_pts_count", -1)):
    a = sc.sticky.get("last_stl_path", "")
    print("No change, skipping export")
else:
    sc.sticky["last_geo_count"]        = geo_count
    sc.sticky["last_pt_count"]         = pt_count
    sc.sticky["last_strings_count"]    = str_count
    sc.sticky["last_string_pts_count"] = str_pt_count

    # -----------------------------------------------------------------------
    # Build and write binary STL
    # -----------------------------------------------------------------------
    def build_and_write_stl(geo_list, stl_path):
        mesh_list = rg.Mesh()
        for geo in geo_list:
            if isinstance(geo, rg.Mesh):
                geo.Faces.ConvertQuadsToTriangles()
                mesh_list.Append(geo)
            elif isinstance(geo, rg.Brep):
                meshes = rg.Mesh.CreateFromBrep(geo, rg.MeshingParameters.Coarse)
                if meshes:
                    for m in meshes:
                        m.Faces.ConvertQuadsToTriangles()
                        mesh_list.Append(m)
            elif isinstance(geo, System.Guid):
                rhino_obj = sc.doc.Objects.FindId(geo)
                if rhino_obj:
                    obj_geo = rhino_obj.Geometry
                    if isinstance(obj_geo, rg.Mesh):
                        obj_geo.Faces.ConvertQuadsToTriangles()
                        mesh_list.Append(obj_geo)
                    elif isinstance(obj_geo, rg.Brep):
                        meshes = rg.Mesh.CreateFromBrep(obj_geo, rg.MeshingParameters.Coarse)
                        if meshes:
                            for m in meshes:
                                m.Faces.ConvertQuadsToTriangles()
                                mesh_list.Append(m)

        mesh_list.Faces.ConvertQuadsToTriangles()
        triangles = []
        for i in range(mesh_list.Faces.Count):
            face = mesh_list.Faces[i]
            triangles.append((
                mesh_list.Vertices[face.A],
                mesh_list.Vertices[face.B],
                mesh_list.Vertices[face.C]
            ))
        os.makedirs(os.path.dirname(stl_path), exist_ok=True)
        with open(stl_path, 'wb') as f:
            f.write(b'\0' * 80)
            f.write(struct.pack('<I', len(triangles)))
            for v0, v1, v2 in triangles:
                f.write(struct.pack('<fff', 0, 0, 0))
                f.write(struct.pack('<fff', v0.X, v0.Y, v0.Z))
                f.write(struct.pack('<fff', v1.X, v1.Y, v1.Z))
                f.write(struct.pack('<fff', v2.X, v2.Y, v2.Z))
                f.write(struct.pack('<H', 0))
        return len(triangles)

    os.makedirs("C:/temp/cones", exist_ok=True)
    cone_stl_paths = []
    for i, branch_geos in enumerate(cone_branches):
        path = f"C:/temp/cones/cone_{i}.stl"
        tris = build_and_write_stl(branch_geos, path)
        cone_stl_paths.append(path)
        print(f"  cone_{i}: {tris} triangles -> {path}")

    strings_stl_path = "C:/temp/strings.stl"
    string_tris = build_and_write_stl(strings_list, strings_stl_path)
    print(f"Strings: {string_tris} triangles -> {strings_stl_path}")

    # -----------------------------------------------------------------------
    # RoboDK -- full clean rebuild
    #
    # Hierarchy:
    #   Station
    #   └── Cones  (frame, identity)
    #       ├── strings       (STL, world coords -- no pose override)
    #       ├── Cone_0        (frame, identity)
    #       │   ├── cone_0        (STL, world coords -- no pose override)
    #       │   ├── cone_grab_0   (target, setPoseAbs)
    #       │   └── string_grab_0 (target, setPoseAbs)
    #       ├── Cone_1 ...
    # -----------------------------------------------------------------------
    try:
        sys.path.append("C:/RoboDK/Python")
        from robodk.robolink import Robolink
        from robodk.robomath import Mat

        def identity():
            return Mat([[1,0,0,0],[0,1,0,0],[0,0,1,0],[0,0,0,1]])

        def world_pose(x, y, z):
            return Mat([[1,0,0,x],[0,1,0,y],[0,0,1,z],[0,0,0,1]])

        RDK = Robolink()
        station = RDK.Item("", 1)
        print(f"Station: {station.Name()}")

        def purge_all(name):
            """Delete every item with this exact name, no type filter, loop for dupes."""
            count = 0
            for _ in range(50):
                item = RDK.Item(name)
                if not item.Valid():
                    break
                item.Delete()
                count += 1
            if count:
                print(f"  purged {count}x '{name}'")

        def add_file_and_get_item(stl_path):
            """Load STL, return new item via before/after ID snapshot."""
            before = set(it.item for it in RDK.ItemList(6, False))
            RDK.AddFile(stl_path)
            for it in RDK.ItemList(6, False):
                if it.item not in before:
                    print(f"    -> loaded '{it.Name()}' id={it.item}")
                    return it
            stem = os.path.splitext(os.path.basename(stl_path))[0]
            fb = RDK.Item(stem)
            print(f"    -> fallback name '{stem}' valid={fb.Valid()}")
            return fb

        # -------------------------------------------------------------------
        # STEP 1 -- purge STL objects first (live at station root, survive
        # frame deletion), then targets, then frames
        # -------------------------------------------------------------------
        purge_all("strings")
        for i in range(num_cones):
            purge_all(f"cone_{i}")
        for i in range(num_cones):
            purge_all(f"cone_grab_{i}")
            purge_all(f"string_grab_{i}")
        for i in range(num_cones):
            purge_all(f"Cone_{i}")
        purge_all("Cones")

        # -------------------------------------------------------------------
        # STEP 2 -- rebuild
        # -------------------------------------------------------------------
        cones_frame = RDK.AddFrame("Cones", station)
        cones_frame.setPose(identity())
        print("Created Cones frame")

        # Strings combined STL
        strings_item = add_file_and_get_item(strings_stl_path)
        if strings_item.Valid():
            strings_item.setColor(string_rgba)
            strings_item.setParent(cones_frame)
            print("Strings: ok, green")
        else:
            print("WARNING: strings item not valid")

        for i in range(num_cones):
            cone_frame = RDK.AddFrame(f"Cone_{i}", cones_frame)
            cone_frame.setPose(identity())

            # Cone STL -- no pose override
            cone_obj = add_file_and_get_item(cone_stl_paths[i])
            if cone_obj.Valid():
                cone_obj.setColor(cone_rgba)
                cone_obj.setParent(cone_frame)
                print(f"  Cone_{i}: STL ok")
            else:
                print(f"  WARNING: Cone_{i} STL not valid")

            # cone_grab target
            if i < len(cone_grab_pts) and cone_grab_pts[i] is not None:
                pt = cone_grab_pts[i]
                t = RDK.AddTarget(f"cone_grab_{i}", cone_frame)
                t.setAsCartesianTarget()
                t.setPoseAbs(world_pose(pt.X, pt.Y, pt.Z))
                print(f"  Cone_{i}: cone_grab  ({pt.X:.1f}, {pt.Y:.1f}, {pt.Z:.1f})")
            else:
                print(f"  WARNING: Cone_{i} missing cone_grab (have {len(cone_grab_pts)} pts)")

            # string_grab target
            if i < len(string_grab_pts) and string_grab_pts[i] is not None:
                pt = string_grab_pts[i]
                t = RDK.AddTarget(f"string_grab_{i}", cone_frame)
                t.setAsCartesianTarget()
                t.setPoseAbs(world_pose(pt.X, pt.Y, pt.Z))
                print(f"  Cone_{i}: string_grab ({pt.X:.1f}, {pt.Y:.1f}, {pt.Z:.1f})")
            else:
                print(f"  WARNING: Cone_{i} missing string_grab (have {len(string_grab_pts)} pts)")

        print(f"Done -- {num_cones} cones in tree")

    except Exception as e:
        print(f"RoboDK error: {e}")
        import traceback
        traceback.print_exc()

    sc.sticky["last_stl_path"] = cone_stl_paths[0] if cone_stl_paths else ""
    a = sc.sticky.get("last_stl_path", "")
# ---------- end py3_4 ----------
panel_8 = Panel(py3_4.out)
panel_9 = Panel(py3_4.a)

# ==== cluster Cluster
relay = ClusterInput()
relay_2 = ClusterInput()
relay_3 = ClusterInput()
A = ClusterInput()
B = ClusterInput()
N = ClusterInput()
C = ClusterInput()
B_2 = ClusterInput()
Y = ClusterInput()
vec2pt = Vector2Pt(PointA=A, PointB=B, Unitize=False)  # -> Vector, Length
series = Series(Start=0, Step=N, Count=C)
pt = ConstructPoint(XCoordinate=relay, YCoordinate=relay_3, ZCoordinate=0)
subtraction = Subtraction(A=relay_2, B=relay)
addition = Addition(A=relay_3, B=B_2)
rectangle = Rectangle(Plane=PlaneXY(0, 0, 0), XSize=relay_2, YSize=Y, Radius=0)  # -> Rectangle, Length
pt_2 = ConstructPoint(XCoordinate=subtraction, YCoordinate=addition, ZCoordinate=0)
Y_2 = UnitY(Factor=series)
move = Move(Geometry=rectangle.Rectangle, Motion=vec2pt.Vector)  # -> Geometry, Transform
merge = Merge(Data1=pt, Data2=pt_2)
move_2 = Move(Geometry=graft(merge), Motion=Y_2)  # -> Geometry, Transform
G = ClusterInput()
move_3 = Move(Geometry=move_2.Geometry, Motion=vec2pt.Vector)  # -> flatten(Geometry), Transform
move_4 = Move(Geometry=G, Motion=move_3.Geometry)  # -> Geometry, Transform
lng = ListLength(List=flatten(move_4.Geometry))
L = ClusterOutput(lng)
out_rectangle = ClusterOutput(move.Geometry)
out_cone_centroid_bottoms = ClusterOutput(move_3.Geometry)
out_cones = ClusterOutput(move_4.Geometry)

# ==== cluster Cluster_2
A = ClusterInput()
A_2 = ClusterInput()
B = ClusterInput()
P = ClusterInput()
t = ClusterInput()
division = Division(A=A_2, B=2)
D = ClusterInput()
multiplication = Multiplication(A=A, B=B)
cir = Circle(Plane=P, Radius=division)
rad = Radians(Degrees=D)
subtraction = Subtraction(A=A, B=multiplication)
R = ClusterInput()
Z = UnitZ(Factor=1)
Z_2 = UnitZ(Factor=subtraction)
eval = EvaluateCurve(Curve=reparameterize(cir), Parameter=t)  # -> Point, Tangent, Angle
move = Move(Geometry=P, Motion=Z_2)  # -> Geometry, Transform
vec2pt = Vector2Pt(PointA=move.Geometry, PointB=eval.Point, Unitize=False)  # -> Vector, Length
neg = Negative(Value=eval.Tangent)
filter = StreamFilter(Gate=Toggle(True), Stream0=eval.Tangent, Stream1=neg)
line = LineSDL(Start=move.Geometry, Direction=Z, Length=multiplication)
xprod = CrossProduct(VectorA=vec2pt.Vector, VectorB=Z, Unitize=False)  # -> Vector, Length
vrot = Rotate(Vector=Z, Axis=xprod.Vector, Angle=rad)
end = EndPoints(Curve=line)  # -> Start, End
biarc = BiArc(StartPoint=eval.Point, StartTangent=filter, EndPoint=move.Geometry, EndTangent=vrot, Ratio=R)  # -> FirstArc, SecondArc, flatten(BiArc)
weave = Weave(Pattern=[0, 1], Stream0=line, Stream1=biarc.BiArc, NullGaps=False)  # -> flatten(Weave)
partition = PartitionList(List=weave, Size="2")
panel = Panel(partition)
panel_2 = Panel(biarc.BiArc)
ln = Line(StartPoint=eval.Point, EndPoint=end.End)
join = JoinCurves(Curves=partition, Preserve=False)  # -> flatten(Curves)
panel_3 = ClusterInput()
panel_4 = Panel(ln)
p_n_c = PickNChoose(Pattern=panel_3, Stream0=ln, Stream1=join)
panel_5 = Panel(panel_3)
panel_6 = Panel(p_n_c)
R_2 = ClusterOutput(p_n_c)
panel_7 = Panel(join)

# ==== cluster Cluster_3
C = ClusterInput()
bbox = BoundingBox(Content=C, Plane=PlaneXY(0, 0, 0))  # -> Box, Box_2
debox = DeconstructBox(Box=bbox.Box)  # -> Plane, X, Y, Z
dedomain = DeconstructDomain(Domain=debox.Z)  # -> Start, End
subtraction = Subtraction(A=dedomain.End, B=dedomain.Start)
R = ClusterOutput(subtraction)

# ==== cluster Cluster_4
start_line_1 = ClusterInput()
B = ClusterInput()
A = ClusterInput()
B_2 = ClusterInput()
ln = Line(StartPoint=start_line_1, EndPoint=B)
ln_2 = Line(StartPoint=A, EndPoint=B_2)
N = ClusterInput()
divide = DivideCurve(Curve=ln, Count=expr("x-1", N), Kinks=False)  # -> Points, Tangents, Parameters
divide_2 = DivideCurve(Curve=ln_2, Count=expr("x-1", N), Kinks=False)  # -> Points, Tangents, Parameters
ln_3 = Line(StartPoint=divide.Points, EndPoint=divide_2.Points)
L = ClusterOutput(ln_3)
