# Grasshopper definition grasshopper_to_place_cone_adaptive_end_effector.gh (Grasshopper 1.0.8)

number_slider = Slider(44.6, range=0..1000)
brep = Brep(<brep referenced from the Rhino model>)
pt = Point(Point(0, 0, 0))
number_slider_2 = Slider(150, range=0..5000)
number_slider_3 = Slider(406.4, range=0..1000)
number_slider_4 = Slider(7, range=1..50)
number_slider_5 = Slider(339.6, range=0..1000)
number_slider_6 = Slider(2679.7, range=0..5000)
pt_2 = Point(Point(2409.247621, 1159.851361, 1369.105749))
bbox = BoundingBox(Content=brep, Plane=PlaneXY(0, 0, 0))  # -> Box, Box_2
pt_3 = Point(Point(2409.247621, 943.7312349, 2083.044141))
number_slider_7 = Slider(1, range=1..50)
debox = DeconstructBox(Box=bbox.Box)  # -> Plane, X, Y, Z
division = Division(A=number_slider_5, B="2")
pt_4 = Point(Point(3279.61159, 943.7312349, 2.058135835))
dedomain = DeconstructDomain(Domain=debox.X)  # -> Start, End
number_slider_8 = Slider(600, range=0..5000)
pt_5 = Point(Point(0, 0, 0))
number_slider_9 = Slider(400, range=0..1000)
division_2 = Division(A=number_slider_9, B="-2")
division_3 = Division(A=number_slider_8, B="2")
subtraction = Subtraction(A=dedomain.End, B=dedomain.Start)
mesh = Mesh(<mesh referenced from the Rhino model>)
addition = Addition(A=division_3, B="1200")
cluster = Cluster_3(C=mesh)
pt_6 = ConstructPoint(XCoordinate=addition, YCoordinate=division_2, ZCoordinate="500")
vec = VectorXYZ(
    XComponent=Slider(491.645, range=-8000..2000),
    YComponent=Slider(-260, range=-2000..2000),
    ZComponent=Slider(400, range=-2000..2000))  # -> Vector, Length
number_slider_10 = Slider(8, range=0..100)
cluster_2 = Cluster(
    relay_2=number_slider_3,
    Y=number_slider_6,
    N=number_slider_5,
    C=number_slider_4,
    relay_3=number_slider_2,
    B_2=division,
    G=brep,
    A=pt,
    relay=number_slider,
    B=pt_3)  # -> L, out_cone_centroid_bottoms, out_cones, out_rectangle
pt_7 = Point(Point(2658.44867, 975.3163464, 1555.577932))
pt_8 = Point(pt_6)
vec_2 = VectorXYZ(XComponent="0", YComponent=Slider(823.616, range=-2000..2000), ZComponent="0")  # -> Vector, Length
cluster_3 = Cluster(
    relay_2=number_slider_3,
    Y=number_slider_6,
    N=number_slider_5,
    C=number_slider_4,
    relay_3=number_slider_2,
    B_2=division,
    G=brep,
    A=pt,
    relay=number_slider,
    B=pt_2)  # -> L, out_cone_centroid_bottoms, out_cones, out_rectangle
merge = Merge(
    Data1=number_slider_3,
    Data2=number_slider_4,
    Data3=number_slider_6,
    Data4=number_slider_6,
    Data5=number_slider_2,
    Data6=number_slider,
    Data7=number_slider_7)
cluster_4 = Cluster(
    relay_2=number_slider_3,
    Y=number_slider_6,
    N=number_slider_5,
    C=number_slider_7,
    relay_3=number_slider_2,
    B_2=division,
    G=brep,
    A=pt,
    relay=number_slider,
    B=pt_4)  # -> L, out_cone_centroid_bottoms, out_cones, out_rectangle
yarn_radius = Slider(2, range=0..5)
pt_9 = Point(Point(2880.910316, 975.3163464, 1555.577932))
pt_10 = Point(Point(-25.84423693, 65.60949931, 513.3599551))
pt_11 = Point(Point(0, 0, 0))
pt_12 = Point(Point(2934.405819, 1218.210956, 2033.903443))
pt_13 = Point(Point(2934.405819, 2258.685291, 2033.903443))
cluster_5 = Cluster_5(
    Z=Slider(176.929, range=0..2000),
    B=Slider(296.995, range=0..2000),
    relay_2=Slider(120.436, range=0..2000),
    relay=Slider(105.153, range=0..2000),
    B_2=Slider(3, range=0..2000))  # -> R, B_3, P
vec_3 = VectorXYZ(XComponent="0", YComponent="0", ZComponent=cluster)  # -> Vector, Length
pt_14 = Point(Point(2934.405819, 1218.210956, 2033.903443))
pt_15 = ConstructPoint(XCoordinate=0, YCoordinate=0, ZCoordinate=0)
pt_16 = Point(Point(3091.937875, 1223.763175, 2033.903443))
cluster_6 = Cluster_3(C=brep)
division_4 = Division(A=subtraction, B="2")
mesh_2 = Mesh(<mesh referenced from the Rhino model>)
subtraction_2 = Subtraction(A=cluster_6, B="7")
move = Move(Geometry=cluster_5.R, Motion=vec_3.Vector)  # -> Geometry, Transform
cluster_7 = Cluster_3(C=move.Geometry)
vec_4 = VectorXYZ(XComponent="0", YComponent="1", ZComponent="0")  # -> Vector, Length
pt_17 = Point(Point(2934.405819, 3753.066381, 2033.903443))
pt_18 = Point(Point(3076.70422, 3737.626507, 2033.903443))
move_2 = Move(Geometry=cluster_5.B_3, Motion=vec_3.Vector)  # -> Geometry, Transform
cluster_8 = Cluster_3(C=move_2.Geometry)
addition_2 = Addition(A=cluster_7, B=cluster, C=cluster_8)
move_3 = Move(Geometry=cluster_5.P, Motion=vec_3.Vector)  # -> Geometry, Transform
pt_19 = ConstructPoint(XCoordinate=0, YCoordinate=0, ZCoordinate=addition_2)
pt_20 = Point(Point(2658.44867, 3929.71677, 1555.577932))
pt_21 = Point(Point(2880.910316, 3951.765053, 1555.577932))
pt_22 = Point(Point(2934.405819, 3753.066381, 2033.903443))
addition_3 = Addition(A="42", B="1")
pt_23 = Point(Point(2934.405819, 2708.838534, 2033.903443))
vec_5 = VectorXYZ(XComponent="0", YComponent="0", ZComponent="1")  # -> Vector, Length
vec_6 = VectorXYZ(XComponent="0", YComponent="0", ZComponent="-1")  # -> Vector, Length
vec_7 = VectorXYZ(XComponent="0", YComponent="0", ZComponent="1")  # -> Vector, Length
vec_8 = VectorXYZ(XComponent="0", YComponent="0", ZComponent=subtraction_2)  # -> Vector, Length
pl = PlaneNormal(Origin=pt_15, ZAxis=vec_4.Vector)
pl_2 = PlaneNormal(Origin=pt_19, ZAxis=vec_6.Vector)
pdecon = Deconstruct(Point=pt_8)  # -> XComponent, YComponent, ZComponent
cluster_9 = Cluster(
    relay_2=number_slider_9,
    Y=number_slider_8,
    N=subtraction,
    C=Slider(3, range=1..50),
    relay_3=division_4,
    B_2="0",
    G=brep,
    A=pt_5,
    relay=division_4,
    B=pt_8)  # -> L, out_cone_centroid_bottoms, out_cones, out_rectangle
addition_4 = Addition(A=addition_3, B="1")
pl_3 = PlaneNormal(Origin=pt_10, ZAxis=vec_7.Vector)
merge_2 = Merge(Data1=move.Geometry, Data2=mesh)
pl_4 = PlaneNormal(Origin=pt_11, ZAxis=vec_5.Vector)
rotate = Rotate(Geometry=pl_2, Angle="pi/4", Plane=pl_2)  # -> Geometry, Transform
rotate_2 = Rotate(Geometry=mesh_2, Angle="-1*pi/180*90", Plane=pl)  # -> Geometry, Transform
subtraction_3 = Subtraction(A=pdecon.YComponent, B=division_2)
subtraction_4 = Subtraction(A=pdecon.XComponent, B=division_3)
move_4 = Move(Geometry=cluster_3.out_cone_centroid_bottoms, Motion=vec_8.Vector)  # -> Geometry, Transform
random = Random(Range=Domain(0, 1), Number=cluster_3.L, Seed=addition_4)
cluster_10 = Cluster_4(start_line_1=pt_7, B=pt_9, A=pt_12, B_2=pt_13, N=number_slider_10)
random_2 = Random(Range=Domain(0, 1), Number=cluster_3.L, Seed=addition_3)
cluster_11 = Cluster_4(start_line_1=pt_14, B=pt_16, A=pt_12, B_2=pt_13, N=number_slider_10)
py3 = Python3Script(seed="42", count=cluster_3.L)  # -> flatten(a)
# ---------- py3: Python ----------
import random

# Inputs: count (integer), seed (integer)

random.seed(seed)
a = [random.choice([True, False]) for _ in range(count)]
# ---------- end py3 ----------
cluster_12 = Cluster_4(start_line_1=pt_20, B=pt_21, A=pt_22, B_2=pt_23, N=number_slider_10)
cluster_13 = Cluster_4(start_line_1=pt_7, B=pt_9, A=pt_14, B_2=pt_16, N=number_slider_10)
panel = Panel(cluster_3.L)
panel_2 = Panel(cluster_2.L)
pt_24 = ConstructPoint(XCoordinate=subtraction_4, YCoordinate=subtraction_3, ZCoordinate=pdecon.ZComponent)
panel_3 = Panel(cluster_4.L)
cluster_14 = Cluster_4(start_line_1=pt_17, B=pt_18, A=pt_22, B_2=pt_23, N=number_slider_10)
cluster_15 = Cluster_4(start_line_1=pt_20, B=pt_21, A=pt_17, B_2=pt_18, N=number_slider_10)
panel_4 = Panel(cluster_4.out_cones)
rotate_3 = Rotate(Geometry=cluster_9.out_cone_centroid_bottoms, Angle="pi/2", Plane=pt_8)  # -> Geometry, Transform
rotate_4 = Rotate(Geometry=cluster_9.out_cones, Angle="pi/2", Plane=pt_8)  # -> Geometry, Transform
rotate_5 = Rotate(Geometry=cluster_9.out_rectangle, Angle="pi/2", Plane=pt_8)  # -> Geometry, Transform
merge_3 = Merge(Data1=cluster_13, Data2=cluster_11)
py3_2 = Python3Script(
    static_geometry=flatten(merge_2),
    moving_geometry=move_2.Geometry,
    joint_axis_plane=move_3.Geometry,
    trigger=Toggle(False),
    joint_open_angle="0",
    joint_closed_angle="90",
    import_angle="0",
    pickup_plane=rotate.Geometry,
    knotting_plane=pl_3,
    flange_plane=pl_4,
    pickup_on_moving=Toggle(True),
    knotting_on_moving=Toggle(True))  # -> out, a; inputs static_geometry: tree
# ---------- py3_2: Python ----------
from Grasshopper import DataTree
import Rhino
import Rhino.Geometry as rg
import scriptcontext as sc
import System
import struct
import os
import sys

# ---------------------------------------------------------------------------
# Script 2 — End effector with moving joint and 4 auto-computed TCP tools
# GH inputs:
#   static_geometry    : breps/meshes for static part of EE
#   moving_geometry    : breps/meshes for moving part of EE
#   flange_plane       : plane at robot flange (tool0) origin
#   joint_axis_plane   : plane at pivot point, Z = rotation axis
#   joint_open_angle   : float (degrees) — open position
#   joint_closed_angle : float (degrees) — closed position
#   import_angle       : float (degrees) — display angle in RoboDK
#   reference_angle    : float (degrees) — angle at which pickup/knotting planes are defined
#   pickup_plane       : plane at pickup TCP at reference_angle
#   knotting_plane     : plane at knotting TCP at reference_angle
#   pickup_on_moving   : bool — True if pickup is on the moving part
#   knotting_on_moving : bool — True if knotting is on the moving part
#   trigger            : bool
#
# The script auto-computes open and closed positions by rotating
# pickup_plane and knotting_plane around the joint axis.
# ---------------------------------------------------------------------------

if trigger:
    sc.sticky["last_ee_stl_path"] = ""
    print("Trigger activated, forcing re-run")

def flatten_input(gh_input, exclude_type=None):
    result = []
    if hasattr(gh_input, 'Branches'):
        for branch in gh_input.Branches:
            for item in branch:
                if item is not None:
                    result.append(item)
    elif hasattr(gh_input, '__iter__') and (exclude_type is None or not isinstance(gh_input, exclude_type)):
        for item in gh_input:
            if item is not None:
                result.append(item)
    elif gh_input is not None:
        result.append(gh_input)
    return result

def resolve_plane(item):
    if item is None:
        return None
    if isinstance(item, rg.Plane):
        return item
    if isinstance(item, System.Guid):
        rhino_obj = sc.doc.Objects.FindId(item)
        if rhino_obj:
            geo = rhino_obj.Geometry
            if isinstance(geo, rg.Plane):
                return geo
            if hasattr(geo, 'FrameAt'):
                ok, frame = geo.FrameAt(0, 0)
                if ok:
                    return frame
            centre = geo.GetBoundingBox(True).Center
            return rg.Plane(centre, rg.Vector3d.ZAxis)
        print(f"  Could not find Guid: {item}")
        return None
    if isinstance(item, rg.Point3d):
        return rg.Plane(item, rg.Vector3d.ZAxis)
    if isinstance(item, rg.Point):
        return rg.Plane(item.Location, rg.Vector3d.ZAxis)
    if hasattr(item, 'X') and hasattr(item, 'Y') and hasattr(item, 'Z'):
        return rg.Plane(rg.Point3d(item.X, item.Y, item.Z), rg.Vector3d.ZAxis)
    print(f"  Unknown plane type: {type(item)}")
    return None

def resolve_first_plane(gh_input):
    items = flatten_input(gh_input, exclude_type=rg.Plane)
    if not items:
        return resolve_plane(gh_input)
    for item in items:
        pl = resolve_plane(item)
        if pl is not None:
            return pl
    return None

def resolve_bool(gh_input):
    if gh_input is None:
        return None
    items = flatten_input(gh_input)
    if items:
        return bool(items[0])
    return None

def resolve_float(gh_input):
    if gh_input is None:
        return None
    if isinstance(gh_input, (int, float)):
        return float(gh_input)
    if isinstance(gh_input, str):
        try:
            return float(gh_input.strip())
        except ValueError:
            return None
    items = flatten_input(gh_input)
    if items:
        val = items[0]
        if isinstance(val, str):
            try:
                return float(val.strip())
            except ValueError:
                return None
        try:
            return float(val)
        except (TypeError, ValueError):
            return None
    return None

def build_mesh_from_geo_list(geo_list):
    mesh_list = rg.Mesh()
    for geo in geo_list:
        if isinstance(geo, rg.Mesh):
            geo.Faces.ConvertQuadsToTriangles()
            mesh_list.Append(geo)
        elif isinstance(geo, rg.Brep):
            meshes = rg.Mesh.CreateFromBrep(geo, rg.MeshingParameters.Coarse)
            if meshes:
                for m in meshes:
                    m.Faces.ConvertQuadsToTriangles()
                    mesh_list.Append(m)
        elif isinstance(geo, System.Guid):
            rhino_obj = sc.doc.Objects.FindId(geo)
            if rhino_obj:
                obj_geo = rhino_obj.Geometry
                if isinstance(obj_geo, rg.Mesh):
                    obj_geo.Faces.ConvertQuadsToTriangles()
                    mesh_list.Append(obj_geo)
                elif isinstance(obj_geo, rg.Brep):
                    meshes = rg.Mesh.CreateFromBrep(obj_geo, rg.MeshingParameters.Coarse)
                    if meshes:
                        for m in meshes:
                            m.Faces.ConvertQuadsToTriangles()
                            mesh_list.Append(m)
    mesh_list.Faces.ConvertQuadsToTriangles()
    return mesh_list

def write_stl(mesh, stl_path):
    triangles = []
    for i in range(mesh.Faces.Count):
        face = mesh.Faces[i]
        triangles.append((
            mesh.Vertices[face.A],
            mesh.Vertices[face.B],
            mesh.Vertices[face.C]
        ))
    os.makedirs(os.path.dirname(stl_path), exist_ok=True)
    with open(stl_path, 'wb') as f:
        f.write(b'\0' * 80)
        f.write(struct.pack('<I', len(triangles)))
        for v0, v1, v2 in triangles:
            f.write(struct.pack('<fff', 0, 0, 0))
            f.write(struct.pack('<fff', v0.X, v0.Y, v0.Z))
            f.write(struct.pack('<fff', v1.X, v1.Y, v1.Z))
            f.write(struct.pack('<fff', v2.X, v2.Y, v2.Z))
            f.write(struct.pack('<H', 0))
    return len(triangles)

def write_minimal_stl(path):
    os.makedirs(os.path.dirname(path), exist_ok=True)
    with open(path, 'wb') as f:
        f.write(b'\0' * 80)
        f.write(struct.pack('<I', 1))
        f.write(struct.pack('<fff', 0, 0, 1))
        for _ in range(3):
            f.write(struct.pack('<fff', 0, 0, 0))
        f.write(struct.pack('<H', 0))

# ---------------------------------------------------------------------------
# Collect inputs
# ---------------------------------------------------------------------------
static_geo_list   = flatten_input(static_geometry)           if 'static_geometry'   in dir() else []
moving_geo_list   = flatten_input(moving_geometry)           if 'moving_geometry'   in dir() else []
resolved_flange   = resolve_first_plane(flange_plane)        if 'flange_plane'      in dir() else None
resolved_axis     = resolve_first_plane(joint_axis_plane)    if 'joint_axis_plane'  in dir() else None
resolved_pickup   = resolve_first_plane(pickup_plane)        if 'pickup_plane'      in dir() else None
resolved_knot     = resolve_first_plane(knotting_plane)      if 'knotting_plane'    in dir() else None
pickup_moving     = resolve_bool(pickup_on_moving   if 'pickup_on_moving'   in dir() else None)
knotting_moving   = resolve_bool(knotting_on_moving if 'knotting_on_moving' in dir() else None)
open_angle        = resolve_float(joint_open_angle   if 'joint_open_angle'   in dir() else None)
closed_angle      = resolve_float(joint_closed_angle if 'joint_closed_angle' in dir() else None)
import_angle_val  = resolve_float(import_angle       if 'import_angle'       in dir() else None)
ref_angle_val     = resolve_float(reference_angle    if 'reference_angle'    in dir() else None)

# Defaults
open_angle       = open_angle       if open_angle       is not None else 0.0
closed_angle     = closed_angle     if closed_angle     is not None else 90.0
import_angle_val = import_angle_val if import_angle_val is not None else 0.0
ref_angle_val    = ref_angle_val    if ref_angle_val    is not None else 0.0

print(f"Static geo items   : {len(static_geo_list)}")
print(f"Moving geo items   : {len(moving_geo_list)}")
print(f"flange_plane       : {resolved_flange}")
print(f"joint_axis_plane   : {resolved_axis}")
print(f"open_angle         : {open_angle} deg")
print(f"closed_angle       : {closed_angle} deg")
print(f"import_angle       : {import_angle_val} deg")
print(f"reference_angle    : {ref_angle_val} deg")
print(f"pickup_plane       : {resolved_pickup}")
print(f"knotting_plane     : {resolved_knot}")
print(f"pickup_on_moving   : {pickup_moving}")
print(f"knotting_on_moving : {knotting_moving}")

# ---------------------------------------------------------------------------
# Gate
# ---------------------------------------------------------------------------
if not trigger and sc.sticky.get("last_ee_stl_path", "") != "":
    a = sc.sticky.get("last_ee_stl_path", "")
    print("Trigger not set — skipping.")
else:
    print("Rebuilding...")

    static_stl_path = "C:/temp/end_effector_static.stl"
    moving_stl_path = "C:/temp/end_effector_moving.stl"

    if static_geo_list:
        static_mesh = build_mesh_from_geo_list(static_geo_list)
        static_tris = write_stl(static_mesh, static_stl_path)
        print(f"Static STL: {static_tris} triangles -> {static_stl_path}")
    else:
        print("WARNING: no static geometry")

    if moving_geo_list:
        moving_mesh = build_mesh_from_geo_list(moving_geo_list)
        moving_tris = write_stl(moving_mesh, moving_stl_path)
        print(f"Moving STL: {moving_tris} triangles -> {moving_stl_path}")
    else:
        print("WARNING: no moving geometry")

    try:
        sys.path.append("C:/RoboDK/Python")
        from robodk.robolink import Robolink
        from robodk.robomath import Mat, invH, rotz, pi

        def identity():
            return Mat([[1,0,0,0],[0,1,0,0],[0,0,1,0],[0,0,0,1]])

        def plane_to_mat(plane):
            x = plane.XAxis
            y = plane.YAxis
            z = plane.Normal
            o = plane.Origin
            return Mat([
                [x.X, y.X, z.X, o.X],
                [x.Y, y.Y, z.Y, o.Y],
                [x.Z, y.Z, z.Z, o.Z],
                [0,   0,   0,   1  ],
            ])

        def offset_mat(from_plane, to_plane):
            """Pose of to_plane expressed in from_plane frame."""
            return invH(plane_to_mat(from_plane)) * plane_to_mat(to_plane)

        RDK = Robolink()
        station = RDK.Item("", 1)
        print(f"Station: {station.Name()}")

        def purge_all(name):
            count = 0
            for _ in range(50):
                item = RDK.Item(name)
                if not item.Valid():
                    break
                item.Delete()
                count += 1
            if count:
                print(f"  purged {count}x '{name}'")

        def add_file_and_get_item(path):
            before = set(it.item for it in RDK.ItemList(5, False))
            RDK.AddFile(path)
            for it in RDK.ItemList(5, False):
                if it.item not in before:
                    print(f"  -> loaded '{it.Name()}' id={it.item}")
                    return it
            stem = os.path.splitext(os.path.basename(path))[0]
            fb = RDK.Item(stem)
            print(f"  -> fallback '{stem}' valid={fb.Valid()}")
            return fb

        # Purge old items
        for name in ["end_effector_static", "end_effector_moving", "end_effector",
                     "EndEffector", "MovingPart",
                     "pickup_open", "pickup_closed",
                     "knotting_open", "knotting_closed",
                     "pickup_point", "knotting_point"]:
            purge_all(name)

        robot = RDK.Item("Fanuc R2000iC 125L")
        if not robot.Valid(): robot = RDK.Item("", 4)
        if not robot.Valid(): robot = RDK.Item("", 2)
        print(f"Robot: {robot.Name()}")

        ee_parent = robot if robot.Valid() else station

        # EE organisational frame
        ee_frame = RDK.AddFrame("EndEffector", ee_parent)
        ee_frame.setPose(identity())

        # Static geometry
        if static_geo_list:
            static_obj = add_file_and_get_item(static_stl_path)
            if static_obj.Valid():
                static_obj.setColor([0.6, 0.6, 0.65, 1.0])
                static_obj.setParent(ee_frame)
                print("Static EE: ok")

        # Flange plane — default to world origin XY if not connected
        fo = resolved_flange if resolved_flange is not None else rg.Plane(
            rg.Point3d(0, 0, 0), rg.Vector3d.ZAxis)

        # Moving part frame
        if resolved_axis is not None:
            axis_offset  = offset_mat(fo, resolved_axis)
            import_rad   = import_angle_val * pi / 180.0
            moving_frame = RDK.AddFrame("MovingPart", ee_frame)
            moving_frame.setPose(axis_offset * rotz(import_rad))

            if moving_geo_list:
                moving_obj = add_file_and_get_item(moving_stl_path)
                if moving_obj.Valid():
                    moving_obj.setColor([0.6, 0.6, 0.65, 1.0])
                    moving_obj.setParent(moving_frame)
                    moving_obj.setPose(invH(axis_offset))
                    print("Moving EE: ok")

            angle_name = "MovingPart|open=" + str(open_angle) + "|closed=" + str(closed_angle) + "|import=" + str(import_angle_val)
            moving_frame.setName(angle_name)
            print("Joint angles encoded: " + angle_name)
        else:
            print("WARNING: no joint_axis_plane — moving part not created")

        # ── Tool creation ────────────────────────────────────────────────────
        # For static tools: offset = inv(flange) * tcp
        # For moving tools: offset = inv(flange) * axis * rotz(target - ref) * inv(axis) * tcp
        #   This rotates the TCP from its reference angle to the target angle
        #   around the joint axis, then expresses the result in the flange frame.

        def compute_tcp_offset(tcp_plane, on_moving, target_angle_deg):
            if not on_moving or resolved_axis is None:
                # Static — direct offset from flange
                return offset_mat(fo, tcp_plane)
            else:
                # Rotating — rotate TCP from reference angle to target angle
                delta_rad   = (target_angle_deg - ref_angle_val) * pi / 180.0
                flange_mat  = plane_to_mat(fo)
                axis_mat    = plane_to_mat(resolved_axis)
                tcp_mat     = plane_to_mat(tcp_plane)
                # TCP in axis frame
                tcp_in_axis = invH(axis_mat) * tcp_mat
                # Rotated TCP in axis frame
                rotated_tcp = rotz(delta_rad) * tcp_in_axis
                # Back to flange frame
                return invH(flange_mat) * axis_mat * rotated_tcp

        def create_tool(name, tcp_plane, on_moving, target_angle_deg):
            if tcp_plane is None:
                print(f"WARNING: {name} — no plane, skipping")
                return
            purge_all(name)
            offset = compute_tcp_offset(tcp_plane, on_moving, target_angle_deg)
            stl = "C:/temp/" + name + ".stl"
            write_minimal_stl(stl)
            tool = RDK.AddFile(stl, robot)
            tool.setName(name)
            tool.setPoseTool(offset)
            check = tool.PoseTool()
            print(name + " offset: (" + str(round(offset[0,3],1)) + ", " + str(round(offset[1,3],1)) + ", " + str(round(offset[2,3],1)) + ")")
            print(name + " readback: (" + str(round(check[0,3],1)) + ", " + str(round(check[1,3],1)) + ", " + str(round(check[2,3],1)) + ")")

        pm  = pickup_moving   or False
        km  = knotting_moving or False

        create_tool("pickup_open",     resolved_pickup, pm, open_angle)
        create_tool("pickup_closed",   resolved_pickup, pm, closed_angle)
        create_tool("knotting_open",   resolved_knot,   km, open_angle)
        create_tool("knotting_closed", resolved_knot,   km, closed_angle)

        print("Done")

    except Exception as e:
        print(f"RoboDK error: {e}")
        import traceback
        traceback.print_exc()

    sc.sticky["last_ee_stl_path"] = static_stl_path
    a = static_stl_path
# ---------- end py3_2 ----------
addition_5 = Addition(A=cluster_3.L, B=cluster_2.L, C=cluster_4.L)
merge_4 = Merge(Data1=cluster_15, Data2=cluster_14)
merge_5 = Merge(Data1=cluster_10, Data2=cluster_12)  # -> flatten(Result)
vec_9 = VectorXYZ(XComponent="0", YComponent="1", ZComponent="0")  # -> Vector, Length
py3_3 = Python3Script()  # -> out, a, planes, frame_names
# ---------- py3_3: Python ----------
# GhPython component: Read scraped RoboDK frames and output as Rhino Planes
#
# Inputs:
#   json_path  (str)   -- path to scraped_frames.json
#                         e.g. r"C:\Users\samst\Framework\clones\custom_estimates_using_dhr_methods\robo_dk_output\scraped_frames.json"
#   group      (str)   -- which group to load: "rail_points", "approach_frames", or "all_frames"
#                         default "rail_points"
#   scale      (float) -- unit scale factor applied to x/y/z (default 1.0 for mm->mm,
#                         use 0.001 to convert mm to metres if your Rhino doc is in metres)
#
# Outputs:
#   planes      -- list of Rhino.Geometry.Plane, one per frame
#   origins     -- list of Rhino.Geometry.Point3d  (plane origins only, useful for display)
#   frame_names -- list of str, frame names in the same order

import json
import Rhino.Geometry as rg

# ── defaults (used if inputs are not wired in GhPython component) ─────────────
try:
    json_path
except NameError:
    json_path = None

try:
    group
except NameError:
    group = None

try:
    scale
except NameError:
    scale = None

# ── read the JSON ─────────────────────────────────────────────────────────────
if not json_path:
    json_path = r"C:\Users\samst\Framework\clones\custom_estimates_using_dhr_methods\robo_dk_output\scraped_frames.json"

with open(json_path, "r") as f:
    data = json.load(f)

if group is None or group == "":
    group = "rail_points"

if group not in data:
    available = list(data.keys())
    raise KeyError(f"Group '{group}' not found in JSON. Available groups: {available}")

entries = data[group]

if scale is None:
    scale = 1.0

# ── build planes ──────────────────────────────────────────────────────────────
planes      = []
origins     = []
frame_names = []

for e in entries:
    ox = e["x"] * scale
    oy = e["y"] * scale
    oz = e["z"] * scale

    origin = rg.Point3d(ox, oy, oz)

    xaxis  = rg.Vector3d(e["xaxis"][0], e["xaxis"][1], e["xaxis"][2])
    yaxis  = rg.Vector3d(e["yaxis"][0], e["yaxis"][1], e["yaxis"][2])

    plane = rg.Plane(origin, xaxis, yaxis)

    planes.append(plane)
    origins.append(origin)
    frame_names.append(e["name"])
# ---------- end py3_3 ----------
cluster_16 = Cluster_6(C=rotate_2.Geometry)
cluster_17 = Cluster_6(C=rotate_4.Geometry)
multiplication = Multiplication(A=Slider(15, range=-180..180), B="pi/180")
merge_6 = Merge(Data1=merge_3, Data2=merge_4)
pl_5 = PlaneNormal(Origin=pt_24, ZAxis=vec_9.Vector)
panel_5 = Panel(addition_5)
panel_6 = Panel(py3_2.out)
panel_7 = Panel(py3_3.frame_names)
vec2pt = Vector2Pt(PointA=cluster_16, PointB=cluster_17, Unitize=False)  # -> Vector, Length
cluster_18 = Cluster_7(P=py3_3.planes)
rotate_6 = Rotate(Geometry=rotate_4.Geometry, Angle=multiplication, Plane=pl_5)  # -> Geometry, Transform
tag = TextTag(Location=py3_3.planes, Text=py3_3.frame_names)
panel_8 = Panel(py3_2.a)
move_5 = Move(Geometry=rotate_2.Geometry, Motion=vec2pt.Vector)  # -> Geometry, Transform
vec_10 = VectorXYZ(XComponent=0, YComponent=0, ZComponent=Slider(110.075, range=0..500))  # -> Vector, Length
move_6 = Move(Geometry=rotate_6.Geometry, Motion=vec.Vector)  # -> flatten(Geometry), Transform
brep_2 = Brep(<brep referenced from the Rhino model>)
filter = StreamFilter(Gate=Toggle(True), Stream0=merge_5, Stream1=merge_6)  # -> flatten(Stream)
move_7 = Move(Geometry=move_5.Geometry, Motion=vec_10.Vector)  # -> Geometry, Transform
cluster_19 = Cluster_2(
    A=Slider(480, range=0..1000),
    B=random,
    P=move_4.Geometry,
    A_2=Slider(173.8, range=0..200),
    t=random_2,
    D=Slider(0, range=0..90),
    panel_3=py3,
    R=Slider(0.412, range=0..1))  # -> flatten(R_2)
mesh_3 = MeshBrep(
    Brep=move_6.Geometry,
    Settings={GridMaxCount=0, GridMinCount=16, JaggedSeams=False, MaxEdgeLength=5000, MinEdgeLength=50, MinTolerance=0, Refine=True, RefineAngle=0, RelativeTolerance=0.65, SimplePlanes=True, Tolerance=0})  # -> flatten(Mesh)
xz = XZPlane(Origin=Point(0, 0, 0))
rotate_7 = Rotate(Geometry=move_7.Geometry, Angle=multiplication, Plane=pl_5)  # -> Geometry, Transform
py3_4 = Python3Script(name="celling", trigger=Button(), geometry=brep_2, color=ColourSwatch(SwatchColor=RGB(215, 211, 35)))  # -> out, a
# ---------- py3_4: Python ----------
import Rhino.Geometry as rg
import scriptcontext as sc
import System
import struct
import os
import sys

# ---------------------------------------------------------------------------
# Inputs:
#   geometry   : any geometry (mesh, brep, guid) — flat list or tree
#   name       : string — name for the object in RoboDK
#   color      : colour — optional, defaults to grey
#   trigger    : boolean — set True to push
# ---------------------------------------------------------------------------

if trigger:
    sc.sticky[f"last_{name}_done"] = False
    print(f"Trigger activated for '{name}'")

if not trigger and sc.sticky.get(f"last_{name}_done", False):
    print("No trigger — skipping")
else:
    # -----------------------------------------------------------------------
    # Flatten any input type into a list of geometry items
    # -----------------------------------------------------------------------
    def flatten(gh_input):
        result = []
        if hasattr(gh_input, 'Branches'):
            for branch in gh_input.Branches:
                for item in branch:
                    if item is not None:
                        result.append(item)
        elif hasattr(gh_input, '__iter__') and not isinstance(gh_input, (rg.Mesh, rg.Point3d)):
            for item in gh_input:
                if item is not None:
                    result.append(item)
        elif gh_input is not None:
            result.append(gh_input)
        return result

    geo_list = flatten(geometry)
    print(f"'{name}': {len(geo_list)} items")

    # -----------------------------------------------------------------------
    # Build combined mesh
    # -----------------------------------------------------------------------
    mesh_list = rg.Mesh()
    for geo in geo_list:
        if isinstance(geo, rg.Mesh):
            geo.Faces.ConvertQuadsToTriangles()
            mesh_list.Append(geo)
        elif isinstance(geo, rg.Brep):
            meshes = rg.Mesh.CreateFromBrep(geo, rg.MeshingParameters.Coarse)
            if meshes:
                for m in meshes:
                    m.Faces.ConvertQuadsToTriangles()
                    mesh_list.Append(m)
        elif isinstance(geo, System.Guid):
            obj = sc.doc.Objects.FindId(geo)
            if obj:
                g = obj.Geometry
                if isinstance(g, rg.Mesh):
                    g.Faces.ConvertQuadsToTriangles()
                    mesh_list.Append(g)
                elif isinstance(g, rg.Brep):
                    meshes = rg.Mesh.CreateFromBrep(g, rg.MeshingParameters.Coarse)
                    if meshes:
                        for m in meshes:
                            m.Faces.ConvertQuadsToTriangles()
                            mesh_list.Append(m)

    mesh_list.Faces.ConvertQuadsToTriangles()
    triangles = []
    for i in range(mesh_list.Faces.Count):
        face = mesh_list.Faces[i]
        triangles.append((
            mesh_list.Vertices[face.A],
            mesh_list.Vertices[face.B],
            mesh_list.Vertices[face.C]
        ))
    print(f"  {len(triangles)} triangles")

    # -----------------------------------------------------------------------
    # Write STL
    # -----------------------------------------------------------------------
    safe_name = name.replace(" ", "_")
    stl_path = f"C:/temp/{safe_name}.stl"
    os.makedirs("C:/temp", exist_ok=True)
    with open(stl_path, 'wb') as f:
        f.write(b'\0' * 80)
        f.write(struct.pack('<I', len(triangles)))
        for v0, v1, v2 in triangles:
            f.write(struct.pack('<fff', 0, 0, 0))
            f.write(struct.pack('<fff', v0.X, v0.Y, v0.Z))
            f.write(struct.pack('<fff', v1.X, v1.Y, v1.Z))
            f.write(struct.pack('<fff', v2.X, v2.Y, v2.Z))
            f.write(struct.pack('<H', 0))
    print(f"  STL -> {stl_path}")

    # -----------------------------------------------------------------------
    # Resolve colour input to [R, G, B, A] 0-1
    # -----------------------------------------------------------------------
    def resolve_color(c, default):
        if c is None:
            return default
        raw = c
        if hasattr(c, 'Branches'):
            try: raw = list(c.Branches[0])[0]
            except: return default
        if type(raw).__name__ == 'Color' or (hasattr(raw, 'R') and hasattr(raw, 'G') and hasattr(raw, 'B')):
            return [raw.R/255.0, raw.G/255.0, raw.B/255.0, raw.A/255.0 if hasattr(raw,'A') else 1.0]
        return default

    rgba = resolve_color(color, [0.6, 0.6, 0.65, 1.0])

    # -----------------------------------------------------------------------
    # Push to RoboDK
    # -----------------------------------------------------------------------
    try:
        sys.path.append("C:/RoboDK/Python")
        from robodk.robolink import Robolink

        RDK = Robolink()
        station = RDK.Item("", 1)
        print(f"  Station: {station.Name()}")

        # Purge any existing item with this name
        for _ in range(50):
            old = RDK.Item(safe_name)
            if not old.Valid(): break
            old.Delete()
            print(f"  purged old '{safe_name}'")

        # Load via snapshot
        before = set(it.item for it in RDK.ItemList(6, False))
        RDK.AddFile(stl_path)
        new_item = None
        for it in RDK.ItemList(6, False):
            if it.item not in before:
                new_item = it
                break
        if new_item is None:
            new_item = RDK.Item(safe_name)

        if new_item.Valid():
            new_item.setColor(rgba)
            print(f"  '{new_item.Name()}' loaded, color={[round(v,2) for v in rgba]}")
        else:
            print(f"  WARNING: item not valid after load")

        sc.sticky[f"last_{name}_done"] = True

    except Exception as e:
        print(f"RoboDK error: {e}")
        import traceback
        traceback.print_exc()
# ---------- end py3_4 ----------
merge_7 = Merge(Data1=cluster_19, Data2=filter)
move_8 = Move(Geometry=rotate_7.Geometry, Motion=vec.Vector)  # -> flatten(Geometry), Transform
mirror = Mirror(Geometry=move_8.Geometry, Plane=xz)  # -> Geometry, Transform
pipe = Pipe(Curve=merge_7, Radius=yarn_radius, Caps="1", FitRail=False)  # -> flatten(Pipe)
toggle = BooleanToggle(False)
merge_8 = Merge(Data1=move_8.Geometry, Data2=mirror.Geometry)  # -> flatten(Result)
toggle_2 = BooleanToggle(False)
filter_2 = StreamFilter(Gate=toggle, Stream1=cluster_4.out_cones)
filter_3 = StreamFilter(Gate=toggle, Stream1=cluster_2.out_cone_centroid_bottoms)
filter_4 = StreamFilter(Gate=toggle_2, Stream1=cluster_2.out_cones)
filter_5 = StreamFilter(Gate=toggle_2, Stream1=cluster_4.out_cone_centroid_bottoms)
bbox_2 = BoundingBox(Content=merge_8, Plane=PlaneXY(0, 0, 0), UnionBox=True)  # -> Box, Box_2
debox_2 = DeconstructBox(Box=bbox_2.Box)  # -> Plane, X, Y, Z
dedomain_2 = DeconstructDomain(Domain=debox_2.X)  # -> Start, End
merge_9 = Merge(Data1=cluster_3.out_cones, Data2=filter_4, Data3=filter_2)  # -> flatten(Result)
addition_6 = Addition(A=cluster_6, B=Slider(402.308, range=0..1000))

# ---- group: Absolute Maximum
merge_10 = Merge(Data1=dedomain_2.Start, Data2=dedomain_2.End)
abs = Absolute(Value=merge_10)
sort = SortList(Keys=abs, ValuesA=merge_10)  # -> Keys, ValuesA
item = ListItem(List=sort.ValuesA, Index=1, Wrap=True)

# ----
mesh_4 = MeshBrep(
    Brep=pipe,
    Settings={GridMaxCount=0, GridMinCount=16, JaggedSeams=False, MaxEdgeLength=5000, MinEdgeLength=50, MinTolerance=0, Refine=True, RefineAngle=0, RelativeTolerance=0.65, SimplePlanes=True, Tolerance=0})  # -> flatten(Mesh)
flatten = FlattenTree(Tree=merge_9, Path="{0}")
merge_11 = Merge(Data1=cluster_3.out_cone_centroid_bottoms, Data2=filter_5, Data3=filter_3)
vec_11 = VectorXYZ(XComponent="0", YComponent="0", ZComponent=cluster_6)  # -> Vector, Length
move_9 = Move(Geometry=rotate_3.Geometry, Motion=vec_11.Vector)  # -> flatten(Geometry), Transform
rotate_8 = Rotate(Geometry=move_9.Geometry, Angle=multiplication, Plane=pl_5)  # -> Geometry, Transform
move_10 = Move(Geometry=rotate_8.Geometry, Motion=vec.Vector)  # -> flatten(Geometry), Transform
division_5 = Division(A=Slider(-1700, range=-2000..1000), B="2")
vec_12 = VectorXYZ(XComponent="0", YComponent="0", ZComponent=addition_6)  # -> Vector, Length
mesh_5 = MeshBrep(
    Brep=flatten,
    Settings={GridMaxCount=0, GridMinCount=16, JaggedSeams=False, MaxEdgeLength=5000, MinEdgeLength=50, MinTolerance=0, Refine=True, RefineAngle=0, RelativeTolerance=0.65, SimplePlanes=True, Tolerance=0})  # -> flatten(Mesh)
move_11 = Move(Geometry=merge_11, Motion=vec_11.Vector)  # -> flatten(Geometry), Transform
move_12 = Move(Geometry=merge_11, Motion=vec_12.Vector)  # -> flatten(Geometry), Transform
addition_7 = Addition(A=division_5, B=item)
yz = YZPlane(Origin=Point(0, 0, 0))
vec_13 = VectorXYZ(XComponent=addition_7, YComponent=0, ZComponent=0)  # -> Vector, Length
panel_9 = Panel(mesh_5)
panel_10 = Panel(move_11.Geometry)
move_13 = Move(Geometry=yz, Motion=vec_13.Vector)  # -> Geometry, Transform
swatch = ColourSwatch(SwatchColor=RGB(204, 35, 35))
mirror_2 = Mirror(Geometry=merge_8, Plane=move_13.Geometry)  # -> Geometry, Transform
merge_12 = Merge(Data1=merge_8, Data2=mirror_2.Geometry)  # -> flatten(Result)
py3_5 = Python3Script(
    cones=flatten(mesh_5),
    grab_points=flatten(move_11.Geometry),
    trigger=flatten(Button()),
    strings=flatten(mesh_4),
    string_grab_points=flatten(move_12.Geometry),
    cone_color=swatch,
    string_color=swatch)  # -> out, a; inputs cones: list, grab_points: list, trigger: list, strings: list, string_grab_points: list
# ---------- py3_5: Python ----------
from Grasshopper import DataTree
import Rhino
import Rhino.Geometry as rg
import scriptcontext as sc
import System
import struct
import os
import sys

if trigger:
    sc.sticky["last_stl_path"] = ""
    print("Trigger activated, forcing re-run")

def flatten_input(gh_input, exclude_type=None):
    result = []
    if hasattr(gh_input, 'Branches'):
        for branch in gh_input.Branches:
            for item in branch:
                if item is not None:
                    result.append(item)
    elif hasattr(gh_input, '__iter__') and (exclude_type is None or not isinstance(gh_input, exclude_type)):
        for item in gh_input:
            if item is not None:
                result.append(item)
    elif gh_input is not None:
        result.append(gh_input)
    return result

def diagnose_tree(name, gh_input):
    if hasattr(gh_input, 'Branches'):
        paths = list(gh_input.Paths)
        print(f"  {name}: DataTree {len(gh_input.Branches)} branches")
        for j, (path, branch) in enumerate(zip(paths, gh_input.Branches)):
            print(f"    branch[{j}] path={path} items={len(branch)} types={list(set(type(x).__name__ for x in branch))}")
    elif hasattr(gh_input, '__iter__') and not isinstance(gh_input, (rg.Mesh, rg.Point3d, rg.Plane)):
        items = list(gh_input)
        print(f"  {name}: iterable len={len(items)} types={list(set(type(x).__name__ for x in items))}")
    else:
        print(f"  {name}: single {type(gh_input).__name__}")

def resolve_plane(item):
    if item is None:
        return None
    if isinstance(item, rg.Plane):
        return item
    if isinstance(item, System.Guid):
        rhino_obj = sc.doc.Objects.FindId(item)
        if rhino_obj:
            geo = rhino_obj.Geometry
            if isinstance(geo, rg.Plane):
                return geo
            if isinstance(geo, rg.Point):
                item = geo.Location
            elif hasattr(geo, 'Location'):
                item = geo.Location
            else:
                item = geo.GetBoundingBox(True).Center
        else:
            print(f"  Could not find Guid: {item}")
            return None
    if isinstance(item, rg.Point3d):
        return rg.Plane(item, rg.Vector3d.XAxis, rg.Vector3d.YAxis)
    if isinstance(item, rg.Point):
        return rg.Plane(item.Location, rg.Vector3d.XAxis, rg.Vector3d.YAxis)
    if hasattr(item, 'X') and hasattr(item, 'Y') and hasattr(item, 'Z'):
        pt = rg.Point3d(item.X, item.Y, item.Z)
        return rg.Plane(pt, rg.Vector3d.XAxis, rg.Vector3d.YAxis)
    print(f"  Unknown plane/point type: {type(item)}")
    return None

def resolve_color(gh_color, default_rgba):
    if gh_color is None:
        return default_rgba
    def color_from_raw(raw):
        if raw is None:
            return None
        type_name = type(raw).__name__
        if type_name == 'Color' or (hasattr(raw, 'R') and hasattr(raw, 'G') and hasattr(raw, 'B') and hasattr(raw, 'A')):
            return [raw.R / 255.0, raw.G / 255.0, raw.B / 255.0, raw.A / 255.0]
        if isinstance(raw, (list, tuple)) and all(isinstance(v, (int, float)) for v in raw):
            vals = list(raw)[:4]
            if any(v > 1.0 for v in vals):
                vals = [v / 255.0 for v in vals]
            while len(vals) < 4:
                vals.append(1.0)
            return vals
        return None
    if hasattr(gh_color, 'Branches'):
        try:
            return color_from_raw(list(gh_color.Branches[0])[0]) or default_rgba
        except Exception:
            return default_rgba
    result = color_from_raw(gh_color)
    if result:
        return result
    if hasattr(gh_color, '__iter__') and not isinstance(gh_color, str):
        try:
            for item in gh_color:
                if item is not None:
                    result = color_from_raw(item)
                    if result:
                        return result
                    break
        except Exception:
            pass
    return default_rgba

print("=== INPUT DIAGNOSTICS ===")
diagnose_tree("cones", cones)
diagnose_tree("grab_points", grab_points)
diagnose_tree("string_grab_points", string_grab_points)
diagnose_tree("strings", strings)
print("=========================")

cone_rgba   = resolve_color(cone_color,   [1.0, 0.0, 0.0, 1.0])
string_rgba = resolve_color(string_color, [0.0, 1.0, 0.0, 1.0])
print(f"cone_color:   {[round(v,3) for v in cone_rgba]}")
print(f"string_color: {[round(v,3) for v in string_rgba]}")

cone_branches = []
if hasattr(cones, 'Branches') and len(cones.Branches) > 1:
    for branch in cones.Branches:
        items = [item for item in branch if item is not None]
        if items:
            cone_branches.append(items)
    print(f"MODE A: {len(cone_branches)} branches from DataTree")
else:
    flat = flatten_input(cones, exclude_type=rg.Mesh)
    for item in flat:
        cone_branches.append([item])
    print(f"MODE B: {len(cone_branches)} cones from flat list")

strings_list     = flatten_input(strings, exclude_type=rg.Mesh)
cone_grab_planes = [resolve_plane(p) for p in flatten_input(grab_points)]
str_grab_planes  = [resolve_plane(p) for p in flatten_input(string_grab_points)]

num_cones = len(cone_branches)
print(f"num_cones={num_cones}  cone_grabs={len(cone_grab_planes)}  str_grabs={len(str_grab_planes)}  strings={len(strings_list)}")
for i, pl in enumerate(cone_grab_planes):
    if pl: print(f"  cone_grab_{i}: pos=({pl.Origin.X:.1f},{pl.Origin.Y:.1f},{pl.Origin.Z:.1f})  Z=({pl.ZAxis.X:.2f},{pl.ZAxis.Y:.2f},{pl.ZAxis.Z:.2f})")
for i, pl in enumerate(str_grab_planes):
    if pl: print(f"  str_grab_{i}:  pos=({pl.Origin.X:.1f},{pl.Origin.Y:.1f},{pl.Origin.Z:.1f})  Z=({pl.ZAxis.X:.2f},{pl.ZAxis.Y:.2f},{pl.ZAxis.Z:.2f})")

if not trigger and sc.sticky.get("last_stl_path", "") != "":
    a = sc.sticky.get("last_stl_path", "")
    print("Trigger not set — skipping.")
else:
    print("Rebuilding...")

    def build_and_write_stl(geo_list, stl_path):
        mesh_list = rg.Mesh()
        for geo in geo_list:
            if isinstance(geo, rg.Mesh):
                geo.Faces.ConvertQuadsToTriangles()
                mesh_list.Append(geo)
            elif isinstance(geo, rg.Brep):
                meshes = rg.Mesh.CreateFromBrep(geo, rg.MeshingParameters.Coarse)
                if meshes:
                    for m in meshes:
                        m.Faces.ConvertQuadsToTriangles()
                        mesh_list.Append(m)
            elif isinstance(geo, System.Guid):
                rhino_obj = sc.doc.Objects.FindId(geo)
                if rhino_obj:
                    obj_geo = rhino_obj.Geometry
                    if isinstance(obj_geo, rg.Mesh):
                        obj_geo.Faces.ConvertQuadsToTriangles()
                        mesh_list.Append(obj_geo)
                    elif isinstance(obj_geo, rg.Brep):
                        meshes = rg.Mesh.CreateFromBrep(obj_geo, rg.MeshingParameters.Coarse)
                        if meshes:
                            for m in meshes:
                                m.Faces.ConvertQuadsToTriangles()
                                mesh_list.Append(m)
        mesh_list.Faces.ConvertQuadsToTriangles()
        triangles = []
        for i in range(mesh_list.Faces.Count):
            face = mesh_list.Faces[i]
            triangles.append((mesh_list.Vertices[face.A], mesh_list.Vertices[face.B], mesh_list.Vertices[face.C]))
        os.makedirs(os.path.dirname(stl_path), exist_ok=True)
        with open(stl_path, 'wb') as f:
            f.write(b'\0' * 80)
            f.write(struct.pack('<I', len(triangles)))
            for v0, v1, v2 in triangles:
                f.write(struct.pack('<fff', 0, 0, 0))
                f.write(struct.pack('<fff', v0.X, v0.Y, v0.Z))
                f.write(struct.pack('<fff', v1.X, v1.Y, v1.Z))
                f.write(struct.pack('<fff', v2.X, v2.Y, v2.Z))
                f.write(struct.pack('<H', 0))
        return len(triangles)

    os.makedirs("C:/temp/cones", exist_ok=True)
    cone_stl_paths = []
    for i, branch_geos in enumerate(cone_branches):
        path = f"C:/temp/cones/cone_{i}.stl"
        tris = build_and_write_stl(branch_geos, path)
        cone_stl_paths.append(path)
        print(f"  cone_{i}: {tris} triangles -> {path}")

    strings_stl_path = "C:/temp/strings.stl"
    string_tris = build_and_write_stl(strings_list, strings_stl_path)
    print(f"Strings: {string_tris} triangles -> {strings_stl_path}")

    try:
        sys.path.append("C:/RoboDK/Python")
        from robodk.robolink import Robolink
        from robodk.robomath import Mat

        def identity():
            return Mat([[1,0,0,0],[0,1,0,0],[0,0,1,0],[0,0,0,1]])

        def plane_to_pose(pl):
            x, y, z, o = pl.XAxis, pl.YAxis, pl.ZAxis, pl.Origin
            return Mat([
                [x.X, y.X, z.X, o.X],
                [x.Y, y.Y, z.Y, o.Y],
                [x.Z, y.Z, z.Z, o.Z],
                [0,   0,   0,   1  ]
            ])

        RDK = Robolink()
        station = RDK.Item("", 1)
        print(f"Station: {station.Name()}")

        robot = RDK.Item("Fanuc R2000iC 125L")
        if not robot.Valid(): robot = RDK.Item("", 4)
        if not robot.Valid(): robot = RDK.Item("", 2)
        print(f"Robot: {robot.Name()}")

        world_frame = RDK.Item("WorldFrame")
        if not world_frame.Valid():
            world_frame = RDK.AddFrame("WorldFrame", station)
            world_frame.setPose(identity())
            print("Created WorldFrame")
        else:
            print("Using existing WorldFrame")

        def purge_all(name):
            count = 0
            for _ in range(50):
                item = RDK.Item(name)
                if not item.Valid():
                    break
                item.Delete()
                count += 1
            if count:
                print(f"  purged {count}x '{name}'")

        def add_file_and_get_item(stl_path):
            # type 5 = object/STL
            before = set(it.item for it in RDK.ItemList(5, False))
            RDK.AddFile(stl_path)
            for it in RDK.ItemList(5, False):
                if it.item not in before:
                    print(f"    -> loaded '{it.Name()}' id={it.item}")
                    return it
            stem = os.path.splitext(os.path.basename(stl_path))[0]
            fb = RDK.Item(stem)
            print(f"    -> fallback name '{stem}' valid={fb.Valid()}")
            return fb

        def make_target(name, pl, parent_frame):
            wf = RDK.Item("WorldFrame")
            rf = RDK.Item("Fanuc R2000iC 125L")
            t = RDK.AddTarget(name, wf, rf)
            t.setAsCartesianTarget()
            t.setPoseAbs(plane_to_pose(pl))
            t.setParent(parent_frame)
            # Re-fetch by name and reapply robot link
            t2 = RDK.Item(name)
            t2.setRobot(RDK.Item("Fanuc R2000iC 125L"))
            # Verify robot link via getLink
            try:
                linked = t2.getLink(2)
                robot_name = linked.Name() if linked.Valid() else "NONE"
            except:
                robot_name = "ERROR"
            print(f"    {name}: parent='{t2.Parent().Name()}' robot='{robot_name}' valid={t2.Valid()}")

        # Purge all old items
        purge_all("strings")
        for i in range(200):
            purge_all(f"cone_grab_{i}")
            purge_all(f"string_grab_{i}")
        for i in range(200):
            purge_all(f"Cone_{i}")
        for i in range(200):
            purge_all(f"cone_{i}")
        purge_all("Cones")

        # Rebuild
        cones_frame = RDK.AddFrame("Cones", station)
        cones_frame.setPose(identity())
        print("Created Cones frame")

        strings_item = add_file_and_get_item(strings_stl_path)
        if strings_item.Valid():
            strings_item.setColor(string_rgba)
            strings_item.setParent(cones_frame)
            print("Strings: ok")
        else:
            print("WARNING: strings item not valid")

        for i in range(num_cones):
            cone_frame = RDK.AddFrame(f"Cone_{i}", cones_frame)
            cone_frame.setPose(identity())

            cone_obj = add_file_and_get_item(cone_stl_paths[i])
            if cone_obj.Valid():
                cone_obj.setColor(cone_rgba)
                cone_obj.setParent(cone_frame)
                print(f"  Cone_{i}: STL ok")
            else:
                print(f"  WARNING: Cone_{i} STL not valid")

            if i < len(cone_grab_planes) and cone_grab_planes[i] is not None:
                make_target(f"cone_grab_{i}", cone_grab_planes[i], RDK.Item(f"Cone_{i}"))
            else:
                print(f"  WARNING: Cone_{i} missing cone_grab plane")

            if i < len(str_grab_planes) and str_grab_planes[i] is not None:
                make_target(f"string_grab_{i}", str_grab_planes[i], RDK.Item(f"Cone_{i}"))
            else:
                print(f"  WARNING: Cone_{i} missing string_grab plane")

        print(f"Done -- {num_cones} cones in tree")

    except Exception as e:
        print(f"RoboDK error: {e}")
        import traceback
        traceback.print_exc()

    sc.sticky["last_stl_path"] = cone_stl_paths[0] if cone_stl_paths else ""
    a = sc.sticky.get("last_stl_path", "")
# ---------- end py3_5 ----------
panel_11 = Panel(py3_5.out)
panel_12 = Panel(py3_5.a)
py3_6 = Python3Script(
    trigger=Button(),
    cones=mesh_3,
    grab_points=move_10.Geometry,
    string_grab_points=move_10.Geometry,
    cone_color=swatch,
    bins=merge_12)  # -> out, a; inputs cones: list, grab_points: list, string_grab_points: list, bins: list
# ---------- py3_6: Python ----------
from Grasshopper import DataTree
import Rhino
import Rhino.Geometry as rg
import scriptcontext as sc
import System
import struct
import os
import sys

# ---------------------------------------------------------------------------
# Script 3 — Base-relative cones + bins (plane inputs for grab orientations)
# GH inputs:
#   cones              : geometry (DataTree one branch per cone, or flat list)
#   grab_points        : flat list of Planes, one per cone
#   string_grab_points : flat list of Planes, one per cone
#   bins               : geometry (flat list or DataTree, one branch per bin)
#   base_origin        : Point in Rhino model space = robot base origin in RoboDK
#   cone_color         : Colour (optional, default orange)
#   string_color       : Colour (optional, default yellow)
#   bin_color          : Colour (optional, default blue)
#   trigger            : Boolean
# ---------------------------------------------------------------------------

if trigger:
    sc.sticky["last_bc_stl_path"] = ""
    print("Trigger activated, forcing re-run")

def flatten_input(gh_input, exclude_type=None):
    result = []
    if hasattr(gh_input, 'Branches'):
        for branch in gh_input.Branches:
            for item in branch:
                if item is not None:
                    result.append(item)
    elif hasattr(gh_input, '__iter__') and (exclude_type is None or not isinstance(gh_input, exclude_type)):
        for item in gh_input:
            if item is not None:
                result.append(item)
    elif gh_input is not None:
        result.append(gh_input)
    return result

def resolve_first_point(gh_input):
    def to_pt(item):
        if isinstance(item, System.Guid):
            rhino_obj = sc.doc.Objects.FindId(item)
            if rhino_obj:
                geo = rhino_obj.Geometry
                if isinstance(geo, rg.Point): return geo.Location
                elif hasattr(geo, 'Location'): return geo.Location
                else: return geo.GetBoundingBox(True).Center
            return None
        if isinstance(item, rg.Point3d): return item
        if isinstance(item, rg.Point): return item.Location
        if hasattr(item, 'X') and hasattr(item, 'Y') and hasattr(item, 'Z'):
            return rg.Point3d(item.X, item.Y, item.Z)
        return None
    items = flatten_input(gh_input, exclude_type=rg.Point3d)
    if not items:
        return to_pt(gh_input)
    for item in items:
        pt = to_pt(item)
        if pt is not None:
            return pt
    return None

def resolve_plane(item):
    if item is None:
        return None
    if isinstance(item, rg.Plane):
        return item
    if isinstance(item, System.Guid):
        rhino_obj = sc.doc.Objects.FindId(item)
        if rhino_obj:
            geo = rhino_obj.Geometry
            if isinstance(geo, rg.Plane):
                return geo
            if isinstance(geo, rg.Point):
                item = geo.Location
            elif hasattr(geo, 'Location'):
                item = geo.Location
            else:
                item = geo.GetBoundingBox(True).Center
        else:
            print(f"  Could not find Guid: {item}")
            return None
    if isinstance(item, rg.Point3d):
        return rg.Plane(item, rg.Vector3d.XAxis, rg.Vector3d.YAxis)
    if isinstance(item, rg.Point):
        return rg.Plane(item.Location, rg.Vector3d.XAxis, rg.Vector3d.YAxis)
    if hasattr(item, 'X') and hasattr(item, 'Y') and hasattr(item, 'Z'):
        return rg.Plane(rg.Point3d(item.X, item.Y, item.Z), rg.Vector3d.XAxis, rg.Vector3d.YAxis)
    print(f"  Unknown plane type: {type(item)}")
    return None

def resolve_color(gh_color, default_rgba):
    if gh_color is None:
        return default_rgba
    def color_from_raw(raw):
        if raw is None: return None
        if type(raw).__name__ == 'Color' or (hasattr(raw,'R') and hasattr(raw,'G') and hasattr(raw,'B') and hasattr(raw,'A')):
            return [raw.R/255.0, raw.G/255.0, raw.B/255.0, raw.A/255.0]
        if isinstance(raw,(list,tuple)) and all(isinstance(v,(int,float)) for v in raw):
            vals = list(raw)[:4]
            if any(v>1.0 for v in vals): vals = [v/255.0 for v in vals]
            while len(vals)<4: vals.append(1.0)
            return vals
        return None
    if hasattr(gh_color,'Branches'):
        try: return color_from_raw(list(gh_color.Branches[0])[0]) or default_rgba
        except: return default_rgba
    result = color_from_raw(gh_color)
    if result: return result
    if hasattr(gh_color,'__iter__') and not isinstance(gh_color,str):
        try:
            for item in gh_color:
                if item is not None:
                    result = color_from_raw(item)
                    if result: return result
                    break
        except: pass
    return default_rgba

def diagnose_tree(name, gh_input):
    if hasattr(gh_input, 'Branches'):
        paths = list(gh_input.Paths)
        print(f"  {name}: DataTree {len(gh_input.Branches)} branches")
        for j, (path, branch) in enumerate(zip(paths, gh_input.Branches)):
            print(f"    branch[{j}] path={path} items={len(branch)} types={list(set(type(x).__name__ for x in branch))}")
    elif hasattr(gh_input, '__iter__') and not isinstance(gh_input, (rg.Mesh, rg.Point3d, rg.Plane)):
        items = list(gh_input)
        print(f"  {name}: iterable len={len(items)} types={list(set(type(x).__name__ for x in items))}")
    else:
        print(f"  {name}: single {type(gh_input).__name__}")

# ---------------------------------------------------------------------------
# Diagnostics
# ---------------------------------------------------------------------------
print("=== INPUT DIAGNOSTICS ===")
diagnose_tree("cones", cones)
diagnose_tree("grab_points", grab_points)
diagnose_tree("string_grab_points", string_grab_points)
diagnose_tree("bins", bins if 'bins' in dir() else None)
print("=========================")

# ---------------------------------------------------------------------------
# Collect inputs
# ---------------------------------------------------------------------------
cone_branches = []
if hasattr(cones, 'Branches') and len(cones.Branches) > 1:
    for branch in cones.Branches:
        items = [item for item in branch if item is not None]
        if items:
            cone_branches.append(items)
    print(f"MODE A: {len(cone_branches)} cone branches from DataTree")
else:
    flat = flatten_input(cones)
    for item in flat:
        cone_branches.append([item])
    print(f"MODE B: {len(cone_branches)} cones from flat list")

# Bins — each item in the flat list or each branch is one bin
bin_branches = []
if 'bins' in dir() and bins is not None:
    if hasattr(bins, 'Branches') and len(bins.Branches) > 1:
        for branch in bins.Branches:
            items = [item for item in branch if item is not None]
            if items:
                bin_branches.append(items)
        print(f"Bins MODE A: {len(bin_branches)} branches from DataTree")
    else:
        flat = flatten_input(bins)
        for item in flat:
            bin_branches.append([item])
        print(f"Bins MODE B: {len(bin_branches)} bins from flat list")
else:
    print("bins: not connected")

cone_grab_planes = [resolve_plane(p) for p in flatten_input(grab_points)]
str_grab_planes  = [resolve_plane(p) for p in flatten_input(string_grab_points)]
base_orig        = resolve_first_point(base_origin) if 'base_origin' in dir() else None
cone_rgba        = resolve_color(cone_color   if 'cone_color'   in dir() else None, [1.0, 0.5, 0.0, 1.0])
string_rgba      = resolve_color(string_color if 'string_color' in dir() else None, [1.0, 1.0, 0.0, 1.0])
bin_rgba         = resolve_color(bin_color    if 'bin_color'    in dir() else None, [0.5, 0.5, 0.5, 1.0])

num_cones = len(cone_branches)
num_bins  = len(bin_branches)
print(f"num_cones={num_cones}  cone_grabs={len(cone_grab_planes)}  str_grabs={len(str_grab_planes)}")
print(f"num_bins={num_bins}")
print(f"base_origin:  {base_orig}")
print(f"cone_color:   {[round(v,3) for v in cone_rgba]}")
print(f"string_color: {[round(v,3) for v in string_rgba]}")
print(f"bin_color:    {[round(v,3) for v in bin_rgba]}")
for i, pl in enumerate(cone_grab_planes):
    if pl: print(f"  cone_grab_{i}: pos=({pl.Origin.X:.1f},{pl.Origin.Y:.1f},{pl.Origin.Z:.1f}) Z=({pl.ZAxis.X:.2f},{pl.ZAxis.Y:.2f},{pl.ZAxis.Z:.2f})")
for i, pl in enumerate(str_grab_planes):
    if pl: print(f"  str_grab_{i}:  pos=({pl.Origin.X:.1f},{pl.Origin.Y:.1f},{pl.Origin.Z:.1f}) Z=({pl.ZAxis.X:.2f},{pl.ZAxis.Y:.2f},{pl.ZAxis.Z:.2f})")
if base_orig is None:
    print("WARNING: base_origin not connected")

# ---------------------------------------------------------------------------
# Gate: trigger only
# ---------------------------------------------------------------------------
if not trigger and sc.sticky.get("last_bc_stl_path", "") != "":
    a = sc.sticky.get("last_bc_stl_path", "")
    print("Trigger not set — skipping.")
else:
    print("Rebuilding...")

    def build_and_write_stl(geo_list, stl_path):
        mesh_list = rg.Mesh()
        for geo in geo_list:
            if isinstance(geo, rg.Mesh):
                geo.Faces.ConvertQuadsToTriangles()
                mesh_list.Append(geo)
            elif isinstance(geo, rg.Brep):
                meshes = rg.Mesh.CreateFromBrep(geo, rg.MeshingParameters.Coarse)
                if meshes:
                    for m in meshes:
                        m.Faces.ConvertQuadsToTriangles()
                        mesh_list.Append(m)
            elif isinstance(geo, System.Guid):
                rhino_obj = sc.doc.Objects.FindId(geo)
                if rhino_obj:
                    obj_geo = rhino_obj.Geometry
                    if isinstance(obj_geo, rg.Mesh):
                        obj_geo.Faces.ConvertQuadsToTriangles()
                        mesh_list.Append(obj_geo)
                    elif isinstance(obj_geo, rg.Brep):
                        meshes = rg.Mesh.CreateFromBrep(obj_geo, rg.MeshingParameters.Coarse)
                        if meshes:
                            for m in meshes:
                                m.Faces.ConvertQuadsToTriangles()
                                mesh_list.Append(m)
        mesh_list.Faces.ConvertQuadsToTriangles()
        triangles = []
        for i in range(mesh_list.Faces.Count):
            face = mesh_list.Faces[i]
            triangles.append((mesh_list.Vertices[face.A], mesh_list.Vertices[face.B], mesh_list.Vertices[face.C]))
        os.makedirs(os.path.dirname(stl_path), exist_ok=True)
        with open(stl_path, 'wb') as f:
            f.write(b'\0' * 80)
            f.write(struct.pack('<I', len(triangles)))
            for v0, v1, v2 in triangles:
                f.write(struct.pack('<fff', 0, 0, 0))
                f.write(struct.pack('<fff', v0.X, v0.Y, v0.Z))
                f.write(struct.pack('<fff', v1.X, v1.Y, v1.Z))
                f.write(struct.pack('<fff', v2.X, v2.Y, v2.Z))
                f.write(struct.pack('<H', 0))
        return len(triangles)

    os.makedirs("C:/temp/base_cones", exist_ok=True)
    os.makedirs("C:/temp/bins", exist_ok=True)

    cone_stl_paths = []
    for i, branch_geos in enumerate(cone_branches):
        path = f"C:/temp/base_cones/base_cone_{i}.stl"
        tris = build_and_write_stl(branch_geos, path)
        cone_stl_paths.append(path)
        print(f"  base_cone_{i}: {tris} triangles -> {path}")

    bin_stl_paths = []
    for i, branch_geos in enumerate(bin_branches):
        path = f"C:/temp/bins/bin_{i}.stl"
        tris = build_and_write_stl(branch_geos, path)
        bin_stl_paths.append(path)
        print(f"  bin_{i}: {tris} triangles -> {path}")

    try:
        sys.path.append("C:/RoboDK/Python")
        from robodk.robolink import Robolink
        from robodk.robomath import Mat

        def identity():
            return Mat([[1,0,0,0],[0,1,0,0],[0,0,1,0],[0,0,0,1]])

        def plane_to_pose(pl):
            x, y, z, o = pl.XAxis, pl.YAxis, pl.ZAxis, pl.Origin
            return Mat([
                [x.X, y.X, z.X, o.X],
                [x.Y, y.Y, z.Y, o.Y],
                [x.Z, y.Z, z.Z, o.Z],
                [0,   0,   0,   1  ]
            ])

        RDK = Robolink()
        station = RDK.Item("", 1)
        print(f"Station: {station.Name()}")

        robot = RDK.Item("Fanuc R2000iC 125L")
        if not robot.Valid(): robot = RDK.Item("", 4)
        if not robot.Valid(): robot = RDK.Item("", 2)
        print(f"Robot: {robot.Name()}")

        robot_base = RDK.Item("Fanuc R2000iC 125LBase")
        if not robot_base.Valid():
            robot_base = robot if robot.Valid() else station
        print(f"Robot base: '{robot_base.Name()}' valid={robot_base.Valid()}")

        world_frame = RDK.Item("WorldFrame")
        if not world_frame.Valid():
            world_frame = RDK.AddFrame("WorldFrame", station)
            world_frame.setPose(identity())
            print("Created WorldFrame")
        else:
            print("Using existing WorldFrame")

        def purge_all(name):
            count = 0
            for _ in range(50):
                item = RDK.Item(name)
                if not item.Valid(): break
                item.Delete()
                count += 1
            if count: print(f"  purged {count}x '{name}'")

        def add_file_and_get_item(stl_path):
            before = set(it.item for it in RDK.ItemList(5, False))
            RDK.AddFile(stl_path)
            for it in RDK.ItemList(5, False):
                if it.item not in before:
                    print(f"    -> loaded '{it.Name()}' id={it.item}")
                    return it
            stem = os.path.splitext(os.path.basename(stl_path))[0]
            fb = RDK.Item(stem)
            print(f"    -> fallback '{stem}' valid={fb.Valid()}")
            return fb

        def make_target(name, pl, parent_frame):
            t = RDK.AddTarget(name, parent_frame)
            t.setAsCartesianTarget()
            t.setPoseAbs(plane_to_pose(pl))
            print(f"    {name}: valid={t.Valid()}")

        # Purge all old items
        for i in range(200):
            purge_all(f"base_cone_grab_{i}")
            purge_all(f"base_str_grab_{i}")
        for i in range(200):
            purge_all(f"BaseCone_{i}")
        for i in range(200):
            purge_all(f"base_cone_{i}")
        for i in range(200):
            purge_all(f"bin_{i}")
        for i in range(200):
            purge_all(f"Bin_{i}")
        purge_all("Bins")
        purge_all("BaseCones")

        # Rebuild cones
        base_cones_frame = RDK.AddFrame("BaseCones", robot_base)
        base_cones_frame.setPose(identity())
        print("Created BaseCones frame")

        for i in range(num_cones):
            cone_frame = RDK.AddFrame(f"BaseCone_{i}", base_cones_frame)
            cone_frame.setPose(identity())

            cone_obj = add_file_and_get_item(cone_stl_paths[i])
            if cone_obj.Valid():
                cone_obj.setColor(cone_rgba)
                cone_obj.setParent(cone_frame)
                cone_obj.setPoseAbs(identity())
                print(f"  BaseCone_{i}: STL ok")
            else:
                print(f"  WARNING: BaseCone_{i} STL not valid")

            if i < len(cone_grab_planes) and cone_grab_planes[i] is not None:
                make_target(f"base_cone_grab_{i}", cone_grab_planes[i], RDK.Item(f"BaseCone_{i}"))
            else:
                print(f"  WARNING: BaseCone_{i} missing cone_grab plane")

            if i < len(str_grab_planes) and str_grab_planes[i] is not None:
                make_target(f"base_str_grab_{i}", str_grab_planes[i], RDK.Item(f"BaseCone_{i}"))
            else:
                print(f"  WARNING: BaseCone_{i} missing str_grab plane")

        # Rebuild bins — no grab targets, just geometry
        if num_bins > 0:
            bins_frame = RDK.AddFrame("Bins", robot_base)
            bins_frame.setPose(identity())
            print("Created Bins frame")

            for i in range(num_bins):
                bin_frame = RDK.AddFrame(f"Bin_{i}", bins_frame)
                bin_frame.setPose(identity())

                bin_obj = add_file_and_get_item(bin_stl_paths[i])
                if bin_obj.Valid():
                    bin_obj.setColor(bin_rgba)
                    bin_obj.setParent(bin_frame)
                    bin_obj.setPoseAbs(identity())
                    print(f"  Bin_{i}: STL ok")
                else:
                    print(f"  WARNING: Bin_{i} STL not valid")

        print(f"Done -- {num_cones} base cones, {num_bins} bins")

    except Exception as e:
        print(f"RoboDK error: {e}")
        import traceback
        traceback.print_exc()

    sc.sticky["last_bc_stl_path"] = cone_stl_paths[0] if cone_stl_paths else ""
    a = sc.sticky.get("last_bc_stl_path", "")
# ---------- end py3_6 ----------

# ==== cluster Cluster
relay = ClusterInput()
relay_2 = ClusterInput()
relay_3 = ClusterInput()
A = ClusterInput()
B = ClusterInput()
N = ClusterInput()
C = ClusterInput()
B_2 = ClusterInput()
Y = ClusterInput()
vec2pt = Vector2Pt(PointA=A, PointB=B, Unitize=False)  # -> Vector, Length
series = Series(Start=0, Step=N, Count=C)
pt = ConstructPoint(XCoordinate=relay, YCoordinate=relay_3, ZCoordinate=0)
subtraction = Subtraction(A=relay_2, B=relay)
addition = Addition(A=relay_3, B=B_2)
rectangle = Rectangle(Plane=PlaneXY(0, 0, 0), XSize=relay_2, YSize=Y, Radius=0)  # -> Rectangle, Length
pt_2 = ConstructPoint(XCoordinate=subtraction, YCoordinate=addition, ZCoordinate=0)
Y_2 = UnitY(Factor=series)
move = Move(Geometry=rectangle.Rectangle, Motion=vec2pt.Vector)  # -> Geometry, Transform
merge = Merge(Data1=pt, Data2=pt_2)
move_2 = Move(Geometry=graft(merge), Motion=Y_2)  # -> Geometry, Transform
out_rectangle = ClusterOutput(move.Geometry)
move_3 = Move(Geometry=move_2.Geometry, Motion=vec2pt.Vector)  # -> flatten(Geometry), Transform
G = ClusterInput()
vec = VectorXYZ(XComponent="0", YComponent="0", ZComponent="1")  # -> Vector, Length
move_4 = Move(Geometry=G, Motion=move_3.Geometry)  # -> Geometry, Transform
lng = ListLength(List=flatten(move_4.Geometry))
pl = PlaneNormal(Origin=move_3.Geometry, ZAxis=vec.Vector)
L = ClusterOutput(lng)
out_cone_centroid_bottoms = ClusterOutput(pl)
out_cones = ClusterOutput(move_4.Geometry)

# ==== cluster Cluster_2
A = ClusterInput()
A_2 = ClusterInput()
B = ClusterInput()
P = ClusterInput()
t = ClusterInput()
division = Division(A=A_2, B=2)
D = ClusterInput()
multiplication = Multiplication(A=A, B=B)
cir = Circle(Plane=P, Radius=division)
rad = Radians(Degrees=D)
subtraction = Subtraction(A=A, B=multiplication)
R = ClusterInput()
Z = UnitZ(Factor=1)
Z_2 = UnitZ(Factor=subtraction)
eval = EvaluateCurve(Curve=reparameterize(cir), Parameter=t)  # -> Point, Tangent, Angle
move = Move(Geometry=P, Motion=Z_2)  # -> Geometry, Transform
vec2pt = Vector2Pt(PointA=move.Geometry, PointB=eval.Point, Unitize=False)  # -> Vector, Length
neg = Negative(Value=eval.Tangent)
filter = StreamFilter(Gate=Toggle(True), Stream0=eval.Tangent, Stream1=neg)
line = LineSDL(Start=move.Geometry, Direction=Z, Length=multiplication)
xprod = CrossProduct(VectorA=vec2pt.Vector, VectorB=Z, Unitize=False)  # -> Vector, Length
vrot = Rotate(Vector=Z, Axis=xprod.Vector, Angle=rad)
end = EndPoints(Curve=line)  # -> Start, End
biarc = BiArc(StartPoint=eval.Point, StartTangent=filter, EndPoint=move.Geometry, EndTangent=vrot, Ratio=R)  # -> FirstArc, SecondArc, flatten(BiArc)
weave = Weave(Pattern=[0, 1], Stream0=line, Stream1=biarc.BiArc, NullGaps=False)  # -> flatten(Weave)
partition = PartitionList(List=weave, Size="2")
panel = Panel(partition)
panel_2 = Panel(biarc.BiArc)
ln = Line(StartPoint=eval.Point, EndPoint=end.End)
join = JoinCurves(Curves=partition, Preserve=False)  # -> flatten(Curves)
panel_3 = ClusterInput()
panel_4 = Panel(ln)
p_n_c = PickNChoose(Pattern=panel_3, Stream0=ln, Stream1=join)
panel_5 = Panel(panel_3)
panel_6 = Panel(p_n_c)
R_2 = ClusterOutput(p_n_c)
panel_7 = Panel(join)

# ==== cluster Cluster_3
C = ClusterInput()
bbox = BoundingBox(Content=C, Plane=PlaneXY(0, 0, 0))  # -> Box, Box_2
debox = DeconstructBox(Box=bbox.Box)  # -> Plane, X, Y, Z
dedomain = DeconstructDomain(Domain=debox.Z)  # -> Start, End
subtraction = Subtraction(A=dedomain.End, B=dedomain.Start)
R = ClusterOutput(subtraction)

# ==== cluster Cluster_4
start_line_1 = ClusterInput()
B = ClusterInput()
A = ClusterInput()
B_2 = ClusterInput()
ln = Line(StartPoint=start_line_1, EndPoint=B)
ln_2 = Line(StartPoint=A, EndPoint=B_2)
N = ClusterInput()
divide = DivideCurve(Curve=ln, Count=expr("x-1", N), Kinks=False)  # -> Points, Tangents, Parameters
divide_2 = DivideCurve(Curve=ln_2, Count=expr("x-1", N), Kinks=False)  # -> Points, Tangents, Parameters
ln_3 = Line(StartPoint=divide.Points, EndPoint=divide_2.Points)
L = ClusterOutput(ln_3)

# ==== cluster Cluster_5
relay = ClusterInput()
relay_2 = ClusterInput()
B = ClusterInput()
Z = ClusterInput()
pt = ConstructPoint(XCoordinate="0", YCoordinate="0", ZCoordinate="0")
pt_2 = ConstructPoint(XCoordinate="0", YCoordinate="0", ZCoordinate=Z)
pdecon = Deconstruct(Point=pt_2)  # -> XComponent, YComponent, ZComponent
addition = Addition(A=pdecon.ZComponent, B=B)
division = Division(A=relay_2, B="-2")
division_2 = Division(A=relay, B="-2")
vec = VectorXYZ(XComponent="1", YComponent="0", ZComponent="0")  # -> Vector, Length
rectangle = Rectangle(Plane=pt, XSize=relay_2, YSize=relay, Radius=0)  # -> Rectangle, Length
pt_3 = ConstructPoint(XCoordinate=pdecon.XComponent, YCoordinate=pdecon.YComponent, ZCoordinate=addition)
vec_2 = VectorXYZ(XComponent=division, YComponent=division_2, ZComponent="0")  # -> Vector, Length
pdecon_2 = Deconstruct(Point=pt_2)  # -> XComponent, YComponent, ZComponent
division_3 = Division(A=relay_2, B="2")
division_4 = Division(A=relay, B="2")
pdecon_3 = Deconstruct(Point=pt)  # -> XComponent, YComponent, ZComponent
move = Move(Geometry=rectangle.Rectangle, Motion=vec_2.Vector)  # -> Geometry, Transform
subtraction = Subtraction(A=pdecon_2.XComponent, B=division_3)
pt_4 = ConstructPoint(XCoordinate=subtraction, YCoordinate=pdecon_2.YComponent, ZCoordinate=pdecon_2.ZComponent)
subtraction_2 = Subtraction(A=pdecon_2.ZComponent, B=pdecon_3.ZComponent)
vec_3 = VectorXYZ(XComponent="0", YComponent="0", ZComponent=subtraction_2)  # -> Vector, Length
extr = Extrude(Base=move.Geometry, Direction=vec_3.Vector)
cap = CapHoles(Brep=extr)
pdecon_4 = Deconstruct(Point=pt_3)  # -> XComponent, YComponent, ZComponent
B_2 = ClusterInput()
vec_4 = VectorXYZ(XComponent=0, YComponent=0, ZComponent=pdecon_4.ZComponent)  # -> Vector, Length
move_2 = Move(Geometry=move.Geometry, Motion=vec_4.Vector)  # -> Geometry, Transform
pl = PlaneNormal(Origin=pt_4, ZAxis=vec.Vector)
cyl = Cylinder(Base=pl, Radius=division_4, Length=relay_2)
cap_2 = CapHoles(Brep=cyl)
merge = Merge(Data1=cap, Data2=cap_2)
sunion = SolidUnion(Breps=merge)
bbox = BoundingBox(Content=sunion, Plane=PlaneXY(0, 0, 0))  # -> Box, Box_2
debox = DeconstructBox(Box=bbox.Box)  # -> Plane, X, Y, Z
num = Number(debox.Z)
subtraction_3 = Subtraction(A=pdecon_4.ZComponent, B=num)
panel = Panel(num)
subtraction_4 = Subtraction(A=subtraction_3, B=B_2)
multiplication = Multiplication(A=subtraction_4, B="-1")
vec_5 = VectorXYZ(XComponent=0, YComponent=0, ZComponent=multiplication)  # -> Vector, Length
extr_2 = Extrude(Base=move_2.Geometry, Direction=vec_5.Vector)
cap_3 = CapHoles(Brep=extr_2)
R = ClusterOutput(sunion)
B_3 = ClusterOutput(cap_3)
P = ClusterOutput(pl)

# ==== cluster Cluster_6
C = ClusterInput()
bbox = BoundingBox(Content=C, Plane=PlaneXY(0, 0, 0), UnionBox=True)  # -> Box, Box_2
debox = DeconstructBox(Box=bbox.Box)  # -> Plane, X, Y, Z
dedomain = DeconstructDomain(Domain=debox.X)  # -> Start, End
dedomain_2 = DeconstructDomain(Domain=debox.Z)  # -> Start, End
dedomain_3 = DeconstructDomain(Domain=debox.Y)  # -> Start, End
addition = Addition(A=dedomain.Start, B=dedomain.End)
addition_2 = Addition(A=dedomain_3.Start, B=dedomain_3.End)
division = Division(A=addition, B="2")
division_2 = Division(A=addition_2, B="2")
pt = ConstructPoint(XCoordinate=division, YCoordinate=division_2, ZCoordinate=dedomain_2.End)
pt_2 = ClusterOutput(pt)

# ==== cluster Cluster_7
P = ClusterInput()

deplane = DeconstructPlane(Plane=P)  # -> Origin, XAxis, YAxis, ZAxis

# ---- group: Global Settings & Scaling
num = Number(Slider(2.25, range=0..5))
multiplication = Multiplication(A=Slider(6, range=0..50), B=num)
multiplication_2 = Multiplication(A=Slider(2, range=0..20), B=num)
multiplication_3 = Multiplication(A=Slider(20, range=0..100), B=num)
multiplication_4 = Multiplication(A=Slider(100, range=0..500), B=num)
num_2 = Number(multiplication)
num_3 = Number(multiplication_2)
num_4 = Number(multiplication_3)
num_5 = Number(multiplication_4)

# ---- group: Z Axis (Blue)
pl = PlaneNormal(Origin=deplane.Origin, ZAxis=deplane.ZAxis)
multiplication_5 = Multiplication(A=deplane.ZAxis, B=num_5)
move = Move(Geometry=pl, Motion=multiplication_5)  # -> Geometry, Transform
cyl = Cylinder(Base=pl, Radius=num_3, Length=num_5)
cone = Cone(Base=move.Geometry, Radius=num_2, Length=num_4)  # -> Cone, Tip
merge = Merge(Data1=[cyl, cone.Cone])
preview = CustomPreview(Geometry=merge, Material=ColourSwatch(SwatchColor=RGB(0, 0, 255)))

# ---- group: Y Axis (Green)
pl_2 = PlaneNormal(Origin=deplane.Origin, ZAxis=deplane.YAxis)
multiplication_6 = Multiplication(A=deplane.YAxis, B=num_5)
move_2 = Move(Geometry=pl_2, Motion=multiplication_6)  # -> Geometry, Transform
cyl_2 = Cylinder(Base=pl_2, Radius=num_3, Length=num_5)
cone_2 = Cone(Base=move_2.Geometry, Radius=num_2, Length=num_4)  # -> Cone, Tip
merge_2 = Merge(Data1=[cyl_2, cone_2.Cone])
preview_2 = CustomPreview(Geometry=merge_2, Material=ColourSwatch(SwatchColor=RGB(0, 255, 0)))

# ---- group: X Axis (Red)
pl_3 = PlaneNormal(Origin=deplane.Origin, ZAxis=deplane.XAxis)
multiplication_7 = Multiplication(A=deplane.XAxis, B=num_5)
move_3 = Move(Geometry=pl_3, Motion=multiplication_7)  # -> Geometry, Transform
cyl_3 = Cylinder(Base=pl_3, Radius=num_3, Length=num_5)
cone_3 = Cone(Base=move_3.Geometry, Radius=num_2, Length=num_4)  # -> Cone, Tip
merge_3 = Merge(Data1=[cyl_3, cone_3.Cone])
preview_3 = CustomPreview(Geometry=merge_3, Material=ColourSwatch(SwatchColor=RGB(255, 0, 0)))

# ---- group: Global Settings & Scaling (continued)
geo = Geometry([merge_3, merge_2, merge])
