# Grasshopper definition pivoting_end_effector_v1.gh (Grasshopper 1.0.8)

number_slider = Slider(15, range=0..2000)
number_slider_2 = Slider(9.134, range=0..500)
addition = Addition(A="0", B=number_slider)
pt = ConstructPoint(XCoordinate="0", YCoordinate="0", ZCoordinate=addition)
pt_2 = ConstructPoint(XCoordinate="0", YCoordinate="0", ZCoordinate=Slider(37.384, range=0..2000))
pdecon = Deconstruct(Point=pt_2)  # -> XComponent, YComponent, ZComponent
subtraction = Subtraction(A=pdecon.ZComponent, B=number_slider_2)
pt_3 = Point(pt)
pt_4 = ConstructPoint(XCoordinate=pdecon.XComponent, YCoordinate=pdecon.YComponent, ZCoordinate=subtraction)
number_slider_3 = Slider(7.824, range=0..500)
pt_5 = ConstructPoint(XCoordinate="0", YCoordinate="0", ZCoordinate=number_slider)
pt_6 = Point(pt_4)
box = CenterBox(Base=pt_6, X=Slider(2.706, range=0..500), Y=Slider(7.824, range=0..500), Z=number_slider_2)
box_2 = CenterBox(Base=pt_3, X=Slider(2.706, range=0..500), Y=Slider(7.824, range=0..500), Z=number_slider)
vec = VectorXYZ(XComponent=0, YComponent=0, ZComponent=0)  # -> Vector, Length
pl = PlaneNormal(Origin=Point(0, 0, 0), ZAxis=vec.Vector)
